# Grasshopper definition flusso-acciaio-misto_REV004.ghx (Grasshopper 1.0.8)
# plug-ins: BridGHe

tipo_collegamento_eccentrico = Slider(0, range=0..1)
# Soletta del graticcio — REV004: G1: carpenteria e getto fresco, senza rigidezza delle fasce cls.
# G2/Q/RITIRO: fasce trasversali a quota -h/2 e link rigidi agli assi delle travi.
# Ec,eff = Es/n della stessa fase. Larghezza fascia da passo uniforme, dimezzata alle estremità.
# Il ritiro qui è longitudinale (sezioni miste + autotensioni); il ritiro trasversale della soletta non è applicato.
# Nessuna shell longitudinale sovrapposta alle sezioni miste. Fasce cls non verificate dal checker delle travi.
# Per progressive soletta non uniformi occorre assegnare ogni larghezza tributaria, non la regola uniforme di questo esempio.
offset_locale_asse_trave_mm = Panel("{0, 0, 0}")
# Schema tridimensionale: REV004: due travi, traversi in acciaio e soletta a graticcio. Vedi il gruppo sopra per quote, fasce, link e proprietà di fase.
# L'uscita Bridge Geometry alimenta G1; Grillage Geometry aggiunge il cls solo dopo l'attivazione del misto.
crossfalltable = BridgeCrossfallTable()  # -> Percentages, Stations
jointtree = BridgeJointTree()
altezza_reticolo_traversi_mm = Slider(1500, range=0..3000)
pannelli_reticolari_per_campo = Slider(2, range=0..4)
schema_reticolare = ValueList({"X": 0, "V": 1, "Warren": 2}, selected="X")
# Preview Model Fase 0
# Preview Model Fase 1
# Preview Model Fase 2
collega_incrocio_diagonali = BooleanToggle(False)
# Preview Model Fase 3
# COME USARE: REV004 | Estensione del file personale 99. Analisi Straus memorizzate.
# Dopo modifiche: Run sulle 4 analisi; Run Excel in lettura; Run Build; Run Super Element Check; Generate Report.
# Geometria, coefficienti e ipotesi sono modificabili. Questa è una prova del flusso, non una combinazione normativa automatica.
calcola_4_modelli_straus = BooleanToggle(False)
bridghe_panel = BridGHePanel()
# Ipotesi temporali: Ritiro coerente: εcs = -0.0003171439341670765 (circa -317 µε), dagli input correnti del componente.
# Lo stesso valore alimenta primario, pre-strain/gradiente FEM ed Excel Actions!I4.
# Cache delle quattro analisi invalidate: geometria e ritiro erano precedenti. Ricalcolare Straus.
modello_1 = Panel("G1_GETTO | solo acciaio")
# ORIGINE E FASE: Quattro fasi 10/20/30/40. Azioni G1, G2, RITIRO, Q e WIND.
# Il ritiro primario e secondario hanno un unico coefficiente. Nessun prefisso dipende dall'ordine dei modelli.
# Excel in lettura: Run; Build BridGHe Model: Run; Super Element Check: Run; Bridge Report: Generate.
# C:\Users\g.pacini\Documents\Repository\BridGHe\example\99-Ponte completo GPC\Straus File\F1.st7
panel = Panel("10")
panel_2 = Panel("SE_Travata 1")
reinforcement_steel_b450c = ReinforcementSteelB450C(B450C="B450C")  # -> Material, Information
panel_3 = Panel("C:\Temp\diagramma.png")
modello_2 = Panel("G2_PERMANENTI | n infinito = 18")
# C:\Users\g.pacini\Documents\Repository\BridGHe\example\99-Ponte completo GPC\Straus File\F2.st7
n0 = Panel("7")
panel_4 = Panel("20")
super_element = ValueList({"SE_Travata 1"}, selected="SE_Travata 1")
# Nodo Finale
# PERCORSO E LIMITI: Pioli verificati per sezione/combinazione. Intermedi solo ai punti assegnati; appoggi a x=0/12/24 m.
# Le reazioni sono combinate dalle stesse fonti e dagli stessi coefficienti delle fasi. Sollevamento mantenuto con segno.
# Il modello deve essere ricalcolato prima di aggiornare le verifiche. Opzione Ultimate esplicita; coefficienti DEMO dichiarati nell'Excel.
path = Panel("C:\Users\g.pacini\Documents\Repository\BridGHe\example\99-Ponte completo GPC\Combo_REV002.xlsx")
panel_6 = Panel("30")
# Nodo Intermedi
# Model Check
modello_3 = Panel("Q_TRAFFICO | n0 = 7")
# Sequenza finale: 1 Ricalcola tutte le quattro analisi Straus. 2 Run Excel in lettura. 3 Run Build e Super Element Check. 4 Generate Report.
# Ritiro allineato a -317 µε; i risultati precedenti non valgono per la configurazione attuale.
# Verifiche nel piano N-Mx-Vy: T, M2 e V1 trascurati, conservati nei risultati FEM.
# LIMITI DELL'ESEMPIO: Modello lineare a fasi incrementali, cls non fessurato.
# Combinazioni DEMO per esercitare il flusso; nessuna conformità normativa implicita.
# Verifiche locali di sezione, pioli e irrigiditori. Restano esclusi fatica, instabilità globale, sisma e progetto trasversale della soletta.
results = ValueList({"Dead", "Q_TRAFFICO", "WIND_1"}, selected=["Q_TRAFFICO", "WIND_1"])
panel_8 = Panel("21")
modello_4 = Panel("RITIRO_FEM | n ritiro = 12")
panel_9 = Panel("RIT_P")
value_list = ValueList({"Only Steel": 0, "Composite": 1, "Concrete Excluded": 2}, selected="Composite")
value_list_2 = ValueList({"Only Steel": 0, "Long Term": 1, "Short Term": 2}, selected="Long Term")
value_list_3 = ValueList({"RITIRO_FEM"}, selected="RITIRO_FEM")
panel_10 = Panel("22")
panel_11 = Panel("-0.000035")
# Limite verificatore N Mx Vy: WIND è calcolato in Straus ma il suo coefficiente è ZERO nelle combinazioni di verifica.
# Il verificatore GPC adottato rifiuta correttamente flessione deviata/taglio trasversale/torsione.
# Il vento richiede un percorso di verifica dedicato; non è coperto da questo report.
panel_12 = Panel("RIT_S")

# ---- group: Bridge Support Lines
asse_impalcato_24_m = Curve(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)
progressive_appoggi_mm = Panel("""0
12000
24000""")
sghembo_appoggi_deg = Slider(0, range=-180..180)
supportlines = BridgeSupportLines(Alignment=asse_impalcato_24_m, SupportStations=progressive_appoggi_mm, SkewAngles=sghembo_appoggi_deg)  # -> SupportLines, SpanLengths, SupportCentres

# ---- group: Bridge Slab Layout
larghezza_efficace_soletta_mm = Slider(2500, range=0..10000)
spessore_soletta_mm = Slider(300, range=0..1000)
slablayout = BridgeSlabLayout(
    SideWidths=larghezza_efficace_soletta_mm,
    Thickness=spessore_soletta_mm,
    CrossfallPercent=crossfalltable.Percentages,
    CrossfallStations=crossfalltable.Stations)

# ---- group: Bridge Solid Diaphragms
passo_massimo_traversi_mm = Slider(1000, range=0..4000)
traversi_agli_appoggi = BooleanToggle(True)
soliddiaphragms = BridgeSolidDiaphragms(MaximumSpacing=passo_massimo_traversi_mm, AtSupports=traversi_agli_appoggi)

# ---- group: Bridge Mesh Settings
lunghezza_massima_aste_mm = Slider(2000, range=0..4000)
tolleranza_corda_mm = Slider(5, range=0..10)
passo_aste_soletta_mm = Slider(2000, range=0..4000)
meshsettings = BridgeMeshSettings(
    MaximumElementLength=lunghezza_massima_aste_mm,
    ChordTolerance=tolleranza_corda_mm,
    SlabBeamSpacing=passo_aste_soletta_mm)

# ---- group: Display Settings
abilita_componente = BooleanToggle(True)
mostra_geometria = BooleanToggle(True)
mostra_sezioni = BooleanToggle(True)
mostra_superfici_ombreggiate = BooleanToggle(True)
mostra_armature = BooleanToggle(True)
mostra_carichi = BooleanToggle(False)
mostra_appoggi = BooleanToggle(True)
mostra_svincoli = BooleanToggle(True)
mostra_altri_attributi = BooleanToggle(True)
mostra_assi_locali = BooleanToggle(False)
mostra_etichette = BooleanToggle(False)
scala_simboli = Slider(1, range=0..2)
scala_frecce_carichi = Slider(1, range=0..2)
trasparenza_preview = Slider(0.65, range=0..1.3)
filtro_caso_di_carico_vuoto = Text("")
display_settings = DisplaySettings(
    Enabled=abilita_componente,
    Geometry=mostra_geometria,
    Sections=mostra_sezioni,
    Shaded=mostra_superfici_ombreggiate,
    Reinforcement=mostra_armature,
    Loads=mostra_carichi,
    Supports=mostra_appoggi,
    Releases=mostra_svincoli,
    OtherAttributes=mostra_altri_attributi,
    Axes=mostra_assi_locali,
    Labels=mostra_etichette,
    SymbolScale=scala_simboli,
    LoadScale=scala_frecce_carichi,
    Transparency=trasparenza_preview,
    LoadCase=filtro_caso_di_carico_vuoto)

abilita_componente_2 = BooleanToggle(True)
mostra_geometria_2 = BooleanToggle(True)
mostra_sezioni_2 = BooleanToggle(True)
mostra_superfici_ombreggiate_2 = BooleanToggle(True)
mostra_armature_2 = BooleanToggle(True)
mostra_carichi_2 = BooleanToggle(False)
mostra_appoggi_2 = BooleanToggle(True)
mostra_svincoli_2 = BooleanToggle(True)
mostra_altri_attributi_2 = BooleanToggle(True)
mostra_assi_locali_2 = BooleanToggle(False)
mostra_etichette_2 = BooleanToggle(False)
scala_simboli_2 = Slider(1, range=0..2)
scala_frecce_carichi_2 = Slider(1, range=0..2)
trasparenza_preview_2 = Slider(0.65, range=0..1.3)
filtro_caso_di_carico_vuoto_2 = Text("")
display_settings_2 = DisplaySettings(
    Enabled=abilita_componente_2,
    Geometry=mostra_geometria_2,
    Sections=mostra_sezioni_2,
    Shaded=mostra_superfici_ombreggiate_2,
    Reinforcement=mostra_armature_2,
    Loads=mostra_carichi_2,
    Supports=mostra_appoggi_2,
    Releases=mostra_svincoli_2,
    OtherAttributes=mostra_altri_attributi_2,
    Axes=mostra_assi_locali_2,
    Labels=mostra_etichette_2,
    SymbolScale=scala_simboli_2,
    LoadScale=scala_frecce_carichi_2,
    Transparency=trasparenza_preview_2,
    LoadCase=filtro_caso_di_carico_vuoto_2)

abilita_componente_3 = BooleanToggle(True)
mostra_geometria_3 = BooleanToggle(True)
mostra_sezioni_3 = BooleanToggle(True)
mostra_superfici_ombreggiate_3 = BooleanToggle(True)
mostra_armature_3 = BooleanToggle(True)
mostra_carichi_3 = BooleanToggle(False)
mostra_appoggi_3 = BooleanToggle(True)
mostra_svincoli_3 = BooleanToggle(True)
mostra_altri_attributi_3 = BooleanToggle(True)
mostra_assi_locali_3 = BooleanToggle(False)
mostra_etichette_3 = BooleanToggle(False)
scala_simboli_3 = Slider(1, range=0..2)
scala_frecce_carichi_3 = Slider(1, range=0..2)
trasparenza_preview_3 = Slider(0.65, range=0..1.3)
filtro_caso_di_carico_vuoto_3 = Text("")
display_settings_3 = DisplaySettings(
    Enabled=abilita_componente_3,
    Geometry=mostra_geometria_3,
    Sections=mostra_sezioni_3,
    Shaded=mostra_superfici_ombreggiate_3,
    Reinforcement=mostra_armature_3,
    Loads=mostra_carichi_3,
    Supports=mostra_appoggi_3,
    Releases=mostra_svincoli_3,
    OtherAttributes=mostra_altri_attributi_3,
    Axes=mostra_assi_locali_3,
    Labels=mostra_etichette_3,
    SymbolScale=scala_simboli_3,
    LoadScale=scala_frecce_carichi_3,
    Transparency=trasparenza_preview_3,
    LoadCase=filtro_caso_di_carico_vuoto_3)

abilita_componente_4 = BooleanToggle(True)
mostra_geometria_4 = BooleanToggle(True)
mostra_sezioni_4 = BooleanToggle(True)
mostra_superfici_ombreggiate_4 = BooleanToggle(True)
mostra_armature_4 = BooleanToggle(True)
mostra_carichi_4 = BooleanToggle(False)
mostra_appoggi_4 = BooleanToggle(True)
mostra_svincoli_4 = BooleanToggle(True)
mostra_altri_attributi_4 = BooleanToggle(True)
mostra_assi_locali_4 = BooleanToggle(False)
mostra_etichette_4 = BooleanToggle(False)
scala_simboli_4 = Slider(1, range=0..2)
scala_frecce_carichi_4 = Slider(1, range=0..2)
trasparenza_preview_4 = Slider(0.65, range=0..1.3)
filtro_caso_di_carico_vuoto_4 = Text("")
display_settings_4 = DisplaySettings(
    Enabled=abilita_componente_4,
    Geometry=mostra_geometria_4,
    Sections=mostra_sezioni_4,
    Shaded=mostra_superfici_ombreggiate_4,
    Reinforcement=mostra_armature_4,
    Loads=mostra_carichi_4,
    Supports=mostra_appoggi_4,
    Releases=mostra_svincoli_4,
    OtherAttributes=mostra_altri_attributi_4,
    Axes=mostra_assi_locali_4,
    Labels=mostra_etichette_4,
    SymbolScale=scala_simboli_4,
    LoadScale=scala_frecce_carichi_4,
    Transparency=trasparenza_preview_4,
    LoadCase=filtro_caso_di_carico_vuoto_4)

# ---- group: I Section
larghezza_ala_inferiore_mm = Slider(300, range=0..600)
larghezza_ala_superiore_mm = Slider(300, range=0..600)
altezza_sezione_acciaio_mm = Slider(800, range=0..1600)
spessore_ala_inferiore_mm = Slider(20, range=0..40)
spessore_ala_superiore_mm = Slider(20, range=0..40)
spessore_anima_mm = Slider(12, range=0..24)
raggio_raccordo_sezione_mm = Slider(0, range=0..1)
traversi_h800 = ISection(
    BottomFlangeWidth=larghezza_ala_inferiore_mm,
    TopFlangeWidth=larghezza_ala_superiore_mm,
    Height=altezza_sezione_acciaio_mm,
    BottomFlangeThickness=spessore_ala_inferiore_mm,
    TopFlangeThickness=spessore_ala_superiore_mm,
    WebThickness=spessore_anima_mm,
    Radius=raggio_raccordo_sezione_mm)

# ---- group: Display Settings
abilita_componente_5 = BooleanToggle(True)
mostra_geometria_5 = BooleanToggle(True)
mostra_sezioni_5 = BooleanToggle(True)
mostra_superfici_ombreggiate_5 = BooleanToggle(True)
mostra_armature_5 = BooleanToggle(True)
mostra_carichi_5 = BooleanToggle(False)
mostra_appoggi_5 = BooleanToggle(True)
mostra_svincoli_5 = BooleanToggle(True)
mostra_altri_attributi_5 = BooleanToggle(True)
mostra_assi_locali_5 = BooleanToggle(False)
mostra_etichette_5 = BooleanToggle(False)
scala_simboli_5 = Slider(1, range=0..2)
scala_frecce_carichi_5 = Slider(1, range=0..2)
trasparenza_preview_5 = Slider(0.65, range=0..1.3)
filtro_caso_di_carico_vuoto_5 = Text("")
display_settings_5 = DisplaySettings(
    Enabled=abilita_componente_5,
    Geometry=mostra_geometria_5,
    Sections=mostra_sezioni_5,
    Shaded=mostra_superfici_ombreggiate_5,
    Reinforcement=mostra_armature_5,
    Loads=mostra_carichi_5,
    Supports=mostra_appoggi_5,
    Releases=mostra_svincoli_5,
    OtherAttributes=mostra_altri_attributi_5,
    Axes=mostra_assi_locali_5,
    Labels=mostra_etichette_5,
    SymbolScale=scala_simboli_5,
    LoadScale=scala_frecce_carichi_5,
    Transparency=trasparenza_preview_5,
    LoadCase=filtro_caso_di_carico_vuoto_5)

# ----
multiplication = Multiplication(A=larghezza_efficace_soletta_mm, B=spessore_soletta_mm)

# ---- group: Multiplication
B = Panel("2")
multiplication_2 = Multiplication(A=larghezza_efficace_soletta_mm, B=B)

# ---- group: Concrete
classe_resistenza_calcestruzzo = ValueList({"C8/10": 0, "C12/15": 1, "C16/20": 2, "C20/25": 3, "C25/30": 4, "C28/35": 5, "C32/40": 6, "C35/45": 7, "C40/50": 8, "C45/55": 9, "C50/60": 10, "C55/67": 11, "C60/75": 12, "C70/85": 13, "C80/95": 14, "C90/105": 15}, selected="C32/40")
concrete = Concrete(Name=classe_resistenza_calcestruzzo, Grade=classe_resistenza_calcestruzzo)

# ---- group: Steel
classe_acciaio_carpenteria = ValueList({"S235": 0, "S275": 1, "S355": 2, "S450": 3}, selected="S355")
steel = Steel(Name=classe_acciaio_carpenteria, Grade=classe_acciaio_carpenteria)

# ---- group: Cluster
raggio_raccordo_sezione_mm_2 = Slider(16, range=10..32)
B_2 = Slider(10, range=10..25)
cluster = Cluster(radius=raggio_raccordo_sezione_mm_2, A=larghezza_efficace_soletta_mm, B=B_2)

raggio_raccordo_sezione_mm_3 = Slider(16, range=10..32)
B_3 = Slider(10, range=10..25)
cluster_2 = Cluster(radius=raggio_raccordo_sezione_mm_3, A=larghezza_efficace_soletta_mm, B=B_3)

# ---- group: List Length
list = Panel("""G2_SOLETTA
G2_FINITURE
G2_BARRIERE""")
list_length = ListLength(List=list)

# ---- group: I Section
larghezza_ala_superiore_mm_2 = Slider(600, range=0..1000)
larghezza_ala_inferiore_mm_2 = Slider(800, range=0..1000)
spessore_ala_inferiore_mm_2 = Slider(40, range=0..100)
spessore_ala_superiore_mm_2 = Slider(30, range=0..100)
raggio_raccordo_sezione_mm_4 = Slider(0, range=0..1)
spessore_anima_mm_2 = Slider(15, range=0..100)
altezza_sezione_acciaio_mm_2 = Slider(1800, range=0..10000)
i_section = ISection(
    BottomFlangeWidth=larghezza_ala_inferiore_mm_2,
    TopFlangeWidth=larghezza_ala_superiore_mm_2,
    Height=altezza_sezione_acciaio_mm_2,
    BottomFlangeThickness=spessore_ala_inferiore_mm_2,
    TopFlangeThickness=spessore_ala_superiore_mm_2,
    WebThickness=spessore_anima_mm_2,
    Radius=raggio_raccordo_sezione_mm_4)

# ---- group: List Item
indice_elemento_selezionato = Slider(0, range=0..1)
riavvolgi_indici_fuori_intervallo = BooleanToggle(True)
list_item = ListItem(List=list, Index=indice_elemento_selezionato, Wrap=riavvolgi_indici_fuori_intervallo)  # -> Item, Item1, Item2

# ---- group: Bridge Studs
abilita_componente_6 = BooleanToggle(True)
numero_pioli_per_fila = Slider(2, range=0..4)
diametro_pioli_mm = Slider(22, range=0..44)
altezza_pioli_mm = Slider(180, range=0..360)
passo_longitudinale_pioli_mm = Slider(200, range=0..400)
passo_trasversale_pioli_mm = Slider(150, range=0..300)
resistenza_ultima_pioli_fu_mpa = Slider(450, range=0..900)
coefficiente_pioli_gamma_v = Slider(1.25, range=0..2.5)
diametro_testa_pioli_mm = Slider(35, range=0..70)
spessore_testa_pioli_mm = Slider(10, range=0..20)
copriferro_richiesto_mm = Slider(40, range=0..80)
dettaglio_per_azioni_ripetute = BooleanToggle(True)
pioli_2x22_passo200 = BridgeStuds(
    Enabled=abilita_componente_6,
    CountPerRow=numero_pioli_per_fila,
    Diameter=diametro_pioli_mm,
    Height=altezza_pioli_mm,
    LongitudinalPitch=passo_longitudinale_pioli_mm,
    TransversePitch=passo_trasversale_pioli_mm,
    Fu=resistenza_ultima_pioli_fu_mpa,
    GammaV=coefficiente_pioli_gamma_v,
    HeadDiameter=diametro_testa_pioli_mm,
    HeadThickness=spessore_testa_pioli_mm,
    RequiredCover=copriferro_richiesto_mm,
    RepeatedActionDetail=dettaglio_per_azioni_ripetute)

# ---- group: Load Case
casi_straus_da_importare = Panel("G1_GETTO")
gravità_su_masse_non_strutturali = BooleanToggle(False)
load_case = LoadCase(Name=casi_straus_da_importare, GravityNSM=gravità_su_masse_non_strutturali)

# ---- group: Bridge Intermediate Stiffener
abilita_componente_7 = BooleanToggle(True)
disposizione_irrigiditori = ValueList({"Symmetric": 0, "LeftOnly": 1, "RightOnly": 2, "Unequal": 3}, selected="Symmetric")
larghezza_piatto_sinistro_mm = Slider(200, range=0..400)
spessore_piatto_sinistro_mm = Slider(20, range=0..40)
larghezza_piatto_destro_mm = Slider(200, range=0..400)
spessore_piatto_destro_mm = Slider(20, range=0..40)
lunghezza_pannello_sinistro_mm = Slider(2000, range=0..4000)
lunghezza_pannello_destro_mm = Slider(4000, range=0..8000)
pannelli_di_uguale_lunghezza = BooleanToggle(True)
coefficiente_lunghezza_libera = Slider(1, range=0..2)
compressione_esterna_kn = Slider(0, range=0..1)
eccentricità_carico_x_mm = Slider(0, range=0..1)
verifica_saldature = BooleanToggle(True)
gola_cordone_saldatura_mm = Slider(6, range=0..12)
intermedi_200x20_pannelli2m = BridgeIntermediateStiffener(
    Enabled=abilita_componente_7,
    Layout=disposizione_irrigiditori,
    Width=larghezza_piatto_sinistro_mm,
    Thickness=spessore_piatto_sinistro_mm,
    RightWidth=larghezza_piatto_destro_mm,
    RightThickness=spessore_piatto_destro_mm,
    LeftPanel=lunghezza_pannello_sinistro_mm,
    RightPanel=lunghezza_pannello_destro_mm,
    EqualPanels=pannelli_di_uguale_lunghezza,
    LengthFactor=coefficiente_lunghezza_libera,
    ExternalCompressionKN=compressione_esterna_kn,
    LoadX=eccentricità_carico_x_mm,
    CheckWelds=verifica_saldature,
    WeldThroat=gola_cordone_saldatura_mm)

# ---- group: Bridge Analysis Options
norma_per_le_verifiche = ValueList({"Ntc2018": 0, "Eurocode4": 1}, selected="Eurocode4")
stato_limite = ValueList({"Ultimate": 0, "Rare": 1, "QuasiPermanent": 2}, selected="Ultimate")
considera_sezione_in_classe_4 = BooleanToggle(True)
instabilità_ala_superiore = BooleanToggle(True)
instabilità_ala_inferiore = BooleanToggle(True)
instabilità_anima = BooleanToggle(True)
quota_comune_carico_y_mm = Slider(0, range=0..1)
coefficiente_acciaio_gamma_m0 = Slider(1.05, range=0..2.1)
coefficiente_instabilità_gamma_m1 = Slider(1.1, range=0..2.2)
coefficiente_connessioni_gamma_m2 = Slider(1.25, range=0..2.5)
coefficiente_cls_gamma_c = Slider(1.5, range=0..3)
coefficiente_armature_gamma_s = Slider(1.15, range=0..2.3)
coefficiente_cls_alfa_cc = Slider(0.85, range=0..1.7)
coefficiente_taglio_eta = Slider(1.2, range=0..2.4)
ultimate_solo_dimostrazione = BridgeAnalysisOptions(
    Standard=norma_per_le_verifiche,
    LimitState=stato_limite,
    Class4=considera_sezione_in_classe_4,
    TopFlangeBuckling=instabilità_ala_superiore,
    BottomFlangeBuckling=instabilità_ala_inferiore,
    WebBuckling=instabilità_anima,
    CommonLoadY=quota_comune_carico_y_mm,
    GammaM0=coefficiente_acciaio_gamma_m0,
    GammaM1=coefficiente_instabilità_gamma_m1,
    GammaM2=coefficiente_connessioni_gamma_m2,
    GammaC=coefficiente_cls_gamma_c,
    GammaS=coefficiente_armature_gamma_s,
    AlphaCC=coefficiente_cls_alfa_cc,
    ShearEta=coefficiente_taglio_eta)

# ---- group: Load Case
nome_caso_di_carico = Panel("Q_TRAFFICO")
gravità_su_masse_non_strutturali_2 = BooleanToggle(False)
load_case_2 = LoadCase(Name=nome_caso_di_carico, GravityNSM=gravità_su_masse_non_strutturali_2)

nome_caso_di_carico_2 = Panel("WIND_1")
gravità_su_masse_non_strutturali_3 = BooleanToggle(False)
load_case_3 = LoadCase(Name=nome_caso_di_carico_2, GravityNSM=gravità_su_masse_non_strutturali_3)

# ----
list_length_2 = ListLength(List=list)

# ---- group: Load Case
nome_caso_di_carico_3 = Panel("RITIRO_FEM_LIN")
gravità_su_masse_non_strutturali_4 = BooleanToggle(False)
load_case_4 = LoadCase(Name=nome_caso_di_carico_3, GravityNSM=gravità_su_masse_non_strutturali_4)

nome_caso_di_carico_4 = Panel("RITIRO_FEM_GRAD")
gravità_su_masse_non_strutturali_5 = BooleanToggle(False)
load_case_5 = LoadCase(Name=nome_caso_di_carico_4, GravityNSM=gravità_su_masse_non_strutturali_5)

nome_caso_di_carico_5 = Panel("RITIRO_PRIMARIO")
gravità_su_masse_non_strutturali_6 = BooleanToggle(False)
load_case_6 = LoadCase(Name=nome_caso_di_carico_5, GravityNSM=gravità_su_masse_non_strutturali_6)

# ----
section_geometric_property = SectionGeometricProperty(SectionProperty=i_section)  # -> Name, Area, Xg, Yg, Jxx, Jyy, Angle, J₁₁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

# ---- group: Beam Property
nome_proprietà = Panel("Traversi H800")
formulazione_elemento_trave = ValueList({"Cable [1]": 1, "Truss [2]": 2, "Cutoff Bar [3]": 3, "Beam [5]": 5, "Connection [8]": 8}, selected="Beam [5]")
s355_traversi = BeamProperty(
    Name=nome_proprietà,
    Type=formulazione_elemento_trave,
    Section=traversi_h800,
    Material=steel,
    Name_2=nome_proprietà,
    Type_2=formulazione_elemento_trave,
    Section_2=traversi_h800,
    Material_2=steel,
    Release=1)  # -> Property, Property_2

# ---- group: Creep And Shrinkage Concrete
resistenza_cilindrica_cls_fck_mpa = Slider(32, range=0..64)
modulo_elastico_acciaio_es_mpa = Slider(210000, range=0..420000)
umidità_relativa = Slider(70, range=0..100)
età_applicazione_carico_giorni = Slider(28, range=0..56)
età_finale_calcolo_giorni = Slider(18250, range=0..18250)
classe_cemento = ValueList({"Class R": 0, "Class N": 1, "Class S": 2}, selected="Class N")
età_fine_cura_giorni = Slider(7, range=0..14)
età_attivazione_misto_giorni = Slider(0, range=0..14)
ritiro_da_rh_geometria_ed_età = CreepAndShrinkageConcrete(
    Fck=resistenza_cilindrica_cls_fck_mpa,
    ElasticModulusSteel=modulo_elastico_acciaio_es_mpa,
    ConcreteArea=multiplication,
    RH=umidità_relativa,
    U=multiplication_2,
    T0=età_applicazione_carico_giorni,
    T=età_finale_calcolo_giorni,
    CementType=classe_cemento,
    DryingStart=età_fine_cura_giorni,
    ReferenceAge=età_attivazione_misto_giorni)  # -> N0, N, YTT0, Εcs, TotalShrinkage, DryingShrinkage, AutogenousShrinkage, NotionalSize

# ---- group: Concrete Slab Section
quota_asse_armatura_dalla_faccia_superio = Slider(50, range=0..100)  # "Quota asse armatura dalla faccia superiore [mm]"
quota_asse_armatura_dalla_faccia_inferio = Slider(50, range=0..100)  # "Quota asse armatura dalla faccia inferiore [mm]"
concrete_slab_section = ConcreteSlabSection(
    Height=spessore_soletta_mm,
    Width=larghezza_efficace_soletta_mm,
    RebarArea=cluster,
    TopConcreteCover=quota_asse_armatura_dalla_faccia_superio,
    BottomRebarArea=cluster_2,
    BottomConcreteCover=quota_asse_armatura_dalla_faccia_inferio)

# ---- group: Load Case
gravità_su_masse_non_strutturali_7 = BooleanToggle(False)
load_case_7 = LoadCase(Name=list_item.Item, GravityNSM=gravità_su_masse_non_strutturali_7)

# ---- group: Duplicate Data
valore_ausiliario_da_ripetere = Data(1)
ordine_duplicazione_dati = BooleanToggle(True)
duplicate_data = DuplicateData(Data=valore_ausiliario_da_ripetere, Number=list_length, Order=ordine_duplicazione_dati)

# ---- group: Load Case
gravità_su_masse_non_strutturali_8 = BooleanToggle(False)
load_case_8 = LoadCase(Name=list_item.Item1, GravityNSM=gravità_su_masse_non_strutturali_8)

gravità_su_masse_non_strutturali_9 = BooleanToggle(False)
load_case_9 = LoadCase(Name=list_item.Item2, GravityNSM=gravità_su_masse_non_strutturali_9)

# ----
merge = Merge(Data1=load_case_4, Data2=load_case_5)

# ---- group: Duplicate Data
valore_ausiliario_da_ripetere_2 = Data(1)
ordine_duplicazione_dati_2 = BooleanToggle(True)
duplicate_data_2 = DuplicateData(Data=valore_ausiliario_da_ripetere_2, Number=list_length_2, Order=ordine_duplicazione_dati_2)

# ---- group: Division
A = Panel("210000")
division = Division(A=A, B=ritiro_da_rh_geometria_ed_età.N)

# ----
division_2 = Division(A=A, B=ritiro_da_rh_geometria_ed_età.N0)
division_3 = Division(A=A, B=ritiro_da_rh_geometria_ed_età.N)
subtraction = Subtraction(A=section_geometric_property.Yg, B=altezza_sezione_acciaio_mm_2)

# ---- group: Bridge Section Schedule
progressiva_inizio_regola_mm = Slider(0, range=0..1)
progressiva_fine_regola_mm = Slider(24000, range=0..48000)
famiglia_aste_della_regola = Slider(1, range=0..2)
gruppo_aste_0_tutti = Slider(0, range=0..1)
concio_o_fascia_0_tutti = Slider(0, range=0..1)
scala_iniziale_sezione_adim = Panel("{1, 1, 0}")
scala_finale_sezione_adim = Panel("{1, 1, 0}")
bridge_section_schedule = BridgeSectionSchedule(
    Property=s355_traversi.Property_2,
    Start=progressiva_inizio_regola_mm,
    End=progressiva_fine_regola_mm,
    Family=famiglia_aste_della_regola,
    Group=gruppo_aste_0_tutti,
    Segment=concio_o_fascia_0_tutti,
    StartScale=scala_iniziale_sezione_adim,
    EndScale=scala_finale_sezione_adim)

# ---- group: Composite Beam Property
nome_proprietà_2 = Panel("H1800 600x30 800x40 anima15 + soletta 2500x300")
considera_calcestruzzo_nelle_fasi_miste = BooleanToggle(True)
considera_armature_nella_sezione = BooleanToggle(True)
composite_beam_property = CompositeBeamProperty(
    Name=nome_proprietà_2,
    ConcreteSlabSection=concrete_slab_section,
    SteelSection=i_section,
    ConcreteMaterial=concrete,
    SteelMaterial=steel,
    ReinforcementMaterial=reinforcement_steel_b450c.Material,
    N0=ritiro_da_rh_geometria_ed_età.N0,
    N=ritiro_da_rh_geometria_ed_età.N,
    NRitiro=ritiro_da_rh_geometria_ed_età.N,
    ConsiderConcrete=considera_calcestruzzo_nelle_fasi_miste,
    ConsiderRebars=considera_armature_nella_sezione)  # -> CompositeSection, OnlySteelProperty, N0BeamSection, NBeamSection, NRitiroBeamSection

# ----
merge_2 = Merge(Data1=load_case_7, Data2=load_case_8, Data3=load_case_9)

# ---- group: Load Combination
nome_proprietà_3 = Panel("RITIRO_FEM")
load_combination = LoadCombination(Name=nome_proprietà_3, LoadCases=merge, Coefficients=duplicate_data_2)

# ---- group: Division
B_4 = Panel("2.4")
division_4 = Division(A=division, B=B_4)

B_5 = Panel("2.4")
division_5 = Division(A=division_2, B=B_5)

B_6 = Panel("2.4")
division_6 = Division(A=division_3, B=B_6)

# ----
subtraction_2 = Subtraction(A=subtraction, B=spessore_soletta_mm)

# ---- group: Bridge Family Property
famiglie_aste_da_assegnare = Slider(-1, range=-2..2)
familyproperty = BridgeFamilyProperty(Property=composite_beam_property.OnlySteelProperty, Family=famiglie_aste_da_assegnare)

# ----
composite_shrinkage_actions = CompositeShrinkageActions(CompositeProperty=composite_beam_property.CompositeSection, ConcreteStrain=ritiro_da_rh_geometria_ed_età.Εcs)  # -> StrausPreStrain, Axis2ThermalGradient, FreeCentroidStrain, FreeCurvature

# ---- group: Load Combination
casi_straus_da_importare_2 = Panel("G2_PERMANENTI")
load_combination_2 = LoadCombination(Name=casi_straus_da_importare_2, LoadCases=merge_2, Coefficients=duplicate_data)

# ---- group: Custom Material
nome_materiale = Panel("C32/40 Eeff RITIRO")
categoria_materiale = ValueList({"Steel": 0, "Concrete": 1, "Aluminium": 2, "Rebar": 3, "Undefined": -1}, selected="Concrete")
sistema_unità_di_misura = ValueList({"kNm (m, kN, T, kPa, s, kJ, C)": 0, "SI (m, N, kg, Pa, s, J, C)": 1, "Nmm (mm, N, T, MPa, s, mJ, C)": 2, "PSI (in, lbf, lb, psi, s, btu, F)": 3}, selected="Nmm (mm, N, T, MPa, s, mJ, C)")
coefficiente_di_poisson = Slider(0.2, range=0..1)
dilatazione_termica_1_c = Slider(1e-05, range=0..1)
calcola_g_da_e_e_poisson = BooleanToggle(True)
densità_materiale_t_mm³ = Panel("2.5E-09")
resistenza_caratteristica_mpa = Slider(32, range=0..64)
resistenza_ultima_acciaio_mpa = Slider(0, range=0..1)
cls_equivalente_ritiro = CustomMaterial(
    Name=nome_materiale,
    Kind=categoria_materiale,
    Units=sistema_unità_di_misura,
    ModulusMPa=division,
    PoissonRatio=coefficiente_di_poisson,
    ThermalExpansion1C=dilatazione_termica_1_c,
    ShearModulusMPa=division_4,
    UsePoisson=calcola_g_da_e_e_poisson,
    DensityTonMm³=densità_materiale_t_mm³,
    YieldingMPa=resistenza_caratteristica_mpa,
    StrengthForSteelMPa=resistenza_ultima_acciaio_mpa)

nome_materiale_2 = Panel("C32/40 Eeff Q")
categoria_materiale_2 = ValueList({"Steel": 0, "Concrete": 1, "Aluminium": 2, "Rebar": 3, "Undefined": -1}, selected="Concrete")
sistema_unità_di_misura_2 = ValueList({"kNm (m, kN, T, kPa, s, kJ, C)": 0, "SI (m, N, kg, Pa, s, J, C)": 1, "Nmm (mm, N, T, MPa, s, mJ, C)": 2, "PSI (in, lbf, lb, psi, s, btu, F)": 3}, selected="Nmm (mm, N, T, MPa, s, mJ, C)")
coefficiente_di_poisson_2 = Slider(0.2, range=0..1)
dilatazione_termica_1_c_2 = Slider(1e-05, range=0..1)
calcola_g_da_e_e_poisson_2 = BooleanToggle(True)
densità_materiale_t_mm³_2 = Panel("2.5E-09")
resistenza_caratteristica_mpa_2 = Slider(32, range=0..64)
resistenza_ultima_acciaio_mpa_2 = Slider(0, range=0..1)
cls_equivalente_q = CustomMaterial(
    Name=nome_materiale_2,
    Kind=categoria_materiale_2,
    Units=sistema_unità_di_misura_2,
    ModulusMPa=division_2,
    PoissonRatio=coefficiente_di_poisson_2,
    ThermalExpansion1C=dilatazione_termica_1_c_2,
    ShearModulusMPa=division_5,
    UsePoisson=calcola_g_da_e_e_poisson_2,
    DensityTonMm³=densità_materiale_t_mm³_2,
    YieldingMPa=resistenza_caratteristica_mpa_2,
    StrengthForSteelMPa=resistenza_ultima_acciaio_mpa_2)

nome_materiale_3 = Panel("C32/40 Eeff G2")
categoria_materiale_3 = ValueList({"Steel": 0, "Concrete": 1, "Aluminium": 2, "Rebar": 3, "Undefined": -1}, selected="Concrete")
sistema_unità_di_misura_3 = ValueList({"kNm (m, kN, T, kPa, s, kJ, C)": 0, "SI (m, N, kg, Pa, s, J, C)": 1, "Nmm (mm, N, T, MPa, s, mJ, C)": 2, "PSI (in, lbf, lb, psi, s, btu, F)": 3}, selected="Nmm (mm, N, T, MPa, s, mJ, C)")
coefficiente_di_poisson_3 = Slider(0.2, range=0..1)
dilatazione_termica_1_c_3 = Slider(1e-05, range=0..1)
calcola_g_da_e_e_poisson_3 = BooleanToggle(True)
densità_materiale_t_mm³_3 = Panel("2.5E-09")
resistenza_caratteristica_mpa_3 = Slider(32, range=0..64)
resistenza_ultima_acciaio_mpa_3 = Slider(0, range=0..1)
cls_equivalente_g2 = CustomMaterial(
    Name=nome_materiale_3,
    Kind=categoria_materiale_3,
    Units=sistema_unità_di_misura_3,
    ModulusMPa=division_3,
    PoissonRatio=coefficiente_di_poisson_3,
    ThermalExpansion1C=dilatazione_termica_1_c_3,
    ShearModulusMPa=division_6,
    UsePoisson=calcola_g_da_e_e_poisson_3,
    DensityTonMm³=densità_materiale_t_mm³_3,
    YieldingMPa=resistenza_caratteristica_mpa_3,
    StrengthForSteelMPa=resistenza_ultima_acciaio_mpa_3)

# ---- group: Bridge Girder Axes
offset_trasversali_travi_mm = Panel("""-1500
1500""")
girderaxes = BridgeGirderAxes(TransverseOffsets=offset_trasversali_travi_mm, AxisLevels=subtraction_2)  # -> GirderAxes, GirderCount

# ---- group: Bridge Fabrication Segments
lunghezza_massima_conci_mm = Slider(8000, range=0..16000)
fabrication = BridgeFabricationSegments(
    Alignment=asse_impalcato_24_m,
    GirderAxes=girderaxes.GirderAxes,
    JointSets=jointtree,
    MaximumSegmentLength=lunghezza_massima_conci_mm)  # -> FabricationPlan, SegmentCount, SegmentIDs, StartStations, EndStations, SegmentLengths

# ----
bridgeassembly = BridgeGeometryAssembly(
    Alignment=asse_impalcato_24_m,
    SupportLines=supportlines.SupportLines,
    GirderAxes=girderaxes.GirderAxes,
    SlabLayout=slablayout,
    FabricationPlan=fabrication.FabricationPlan,
    Diaphragms=soliddiaphragms)

# ---- group: Bridge Grillage Mesh
mostra_etichette_6 = BooleanToggle(False)
graticcio_acciaio_soletta_12_12_m_mesh = BridgeGrillageMesh(BridgeDefinition=bridgeassembly, MeshSettings=meshsettings, Labels=mostra_etichette_6)  # -> Members, MemberIDs, Longitudinals, DiaphragmMembers, Nodes, SupportPoints, JointPoints, Deck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

# ----
list_length_3 = ListLength(List=flatten(graticcio_acciaio_soletta_12_12_m_mesh.DeckBeamStations))

# ---- group: List Item
indice_elemento_selezionato_2 = Slider(0, range=0..1)
riavvolgi_indici_fuori_intervallo_2 = BooleanToggle(True)
list_item_2 = ListItem(
    List=flatten(graticcio_acciaio_soletta_12_12_m_mesh.DeckStripWidths),
    Index=indice_elemento_selezionato_2,
    Wrap=riavvolgi_indici_fuori_intervallo_2)

# ----
rigidlinks = BridgeRigidLinks(ConnectionAxes=flatten(graticcio_acciaio_soletta_12_12_m_mesh.DeckConnections))  # -> Elements, Information

# ---- group: Bridge Bearings
tipi_appoggi_in_ordine_supporto_e_trave = Panel("""0
2
1
2
1
2""")
angolo_guida_appoggi_deg = Slider(0, range=-180..180)
rigidezze_traslazionali_n_mm = Panel("{0, 0, 0}")
rigidezze_rotazionali_n_mm_rad = Panel("{0, 0, 0}")
bridge_bearings = BridgeBearings(
    BridgeGeometry=graticcio_acciaio_soletta_12_12_m_mesh.BridgeGeometry,
    Types=tipi_appoggi_in_ordine_supporto_e_trave,
    GuideAngle=angolo_guida_appoggi_deg,
    TranslationStiffness=rigidezze_traslazionali_n_mm,
    RotationStiffness=rigidezze_rotazionali_n_mm_rad)  # -> Nodes, Frames, Labels

# ----
femmembers = BridgeFEMMembers(
    BridgeGeometry=graticcio_acciaio_soletta_12_12_m_mesh.BridgeGeometry,
    FamilyProperties=familyproperty,
    SectionRules=bridge_section_schedule)  # -> Beams, PhysicalIDs, Unassigned, Information
sezione_fascia_estremità = SolidRect(Height=spessore_soletta_mm, Base=list_item_2)

# ---- group: Multiplication
B_7 = Panel("2")
multiplication_3 = Multiplication(A=list_item_2, B=B_7)

# ---- group: Beam Output Stations
outputstations = Slider(4, range=0..10)
beam_output_stations = BeamOutputStations(Beam=femmembers.Beams, OutputStations=outputstations)

# ---- group: Beam Property
nome_proprietà_4 = Panel("Soletta RITIRO estremità")
formulazione_elemento_trave_2 = ValueList({"Cable [1]": 1, "Truss [2]": 2, "Cutoff Bar [3]": 3, "Beam [5]": 5, "Connection [8]": 8}, selected="Beam [5]")
soletta_ritiro_estremità = BeamProperty(
    Name=nome_proprietà_4,
    Type=formulazione_elemento_trave_2,
    Section=sezione_fascia_estremità,
    Material=cls_equivalente_ritiro,
    Name_2=nome_proprietà_4,
    Type_2=formulazione_elemento_trave_2,
    Section_2=sezione_fascia_estremità,
    Material_2=cls_equivalente_ritiro,
    Release=1)  # -> Property, Property_2

nome_proprietà_5 = Panel("Soletta Q estremità")
formulazione_elemento_trave_3 = ValueList({"Cable [1]": 1, "Truss [2]": 2, "Cutoff Bar [3]": 3, "Beam [5]": 5, "Connection [8]": 8}, selected="Beam [5]")
soletta_q_estremità = BeamProperty(
    Name=nome_proprietà_5,
    Type=formulazione_elemento_trave_3,
    Section=sezione_fascia_estremità,
    Material=cls_equivalente_q,
    Name_2=nome_proprietà_5,
    Type_2=formulazione_elemento_trave_3,
    Section_2=sezione_fascia_estremità,
    Material_2=cls_equivalente_q,
    Release=1)  # -> Property, Property_2

nome_proprietà_6 = Panel("Soletta G2 estremità")
formulazione_elemento_trave_4 = ValueList({"Cable [1]": 1, "Truss [2]": 2, "Cutoff Bar [3]": 3, "Beam [5]": 5, "Connection [8]": 8}, selected="Beam [5]")
soletta_g2_estremità = BeamProperty(
    Name=nome_proprietà_6,
    Type=formulazione_elemento_trave_4,
    Section=sezione_fascia_estremità,
    Material=cls_equivalente_g2,
    Name_2=nome_proprietà_6,
    Type_2=formulazione_elemento_trave_4,
    Section_2=sezione_fascia_estremità,
    Material_2=cls_equivalente_g2,
    Release=1)  # -> Property, Property_2

# ----
sezione_fascia_interna = SolidRect(Height=spessore_soletta_mm, Base=multiplication_3)

# ---- group: Super Element
nome_proprietà_7 = Panel("SE_Travata 1")
super_element_2 = SuperElement(Element=beam_output_stations, Name=nome_proprietà_7)

# ---- group: Build Model
nome_modello_fem = Panel("Base - solo acciaio")
sistema_unità_di_misura_4 = ValueList({"kNm (m, kN, T, kPa, s, kJ, C)": 0, "SI (m, N, kg, Pa, s, J, C)": 1, "Nmm (mm, N, T, MPa, s, mJ, C)": 2, "PSI (in, lbf, lb, psi, s, btu, F)": 3}, selected="Nmm (mm, N, T, MPa, s, mJ, C)")
build_model = BuildModel(Elements=[beam_output_stations, bridge_bearings.Nodes], Name=nome_modello_fem, Units=sistema_unità_di_misura_4)

# ---- group: Beam Property
nome_proprietà_8 = Panel("Soletta RITIRO interna")
formulazione_elemento_trave_5 = ValueList({"Cable [1]": 1, "Truss [2]": 2, "Cutoff Bar [3]": 3, "Beam [5]": 5, "Connection [8]": 8}, selected="Beam [5]")
soletta_ritiro_interna = BeamProperty(
    Name=nome_proprietà_8,
    Type=formulazione_elemento_trave_5,
    Section=sezione_fascia_interna,
    Material=cls_equivalente_ritiro,
    Name_2=nome_proprietà_8,
    Type_2=formulazione_elemento_trave_5,
    Section_2=sezione_fascia_interna,
    Material_2=cls_equivalente_ritiro,
    Release=1)  # -> Property, Property_2

# ---- group: Bridge Section Schedule
progressiva_inizio_regola_mm_2 = Slider(0, range=0..1)
progressiva_fine_regola_mm_2 = Slider(24000, range=0..48000)
famiglia_aste_della_regola_2 = Slider(8, range=0..16)
gruppo_aste_0_tutti_2 = Slider(1, range=0..2)
concio_o_fascia_0_tutti_2 = Slider(0, range=0..1)
scala_iniziale_sezione_adim_2 = Panel("{1, 1, 0}")
scala_finale_sezione_adim_2 = Panel("{1, 1, 0}")
bridge_section_schedule_2 = BridgeSectionSchedule(
    Property=soletta_ritiro_estremità.Property_2,
    Start=progressiva_inizio_regola_mm_2,
    End=progressiva_fine_regola_mm_2,
    Family=famiglia_aste_della_regola_2,
    Group=gruppo_aste_0_tutti_2,
    Segment=concio_o_fascia_0_tutti_2,
    StartScale=scala_iniziale_sezione_adim_2,
    EndScale=scala_finale_sezione_adim_2)

progressiva_inizio_regola_mm_3 = Slider(0, range=0..1)
progressiva_fine_regola_mm_3 = Slider(24000, range=0..48000)
famiglia_aste_della_regola_3 = Slider(8, range=0..16)
concio_o_fascia_0_tutti_3 = Slider(0, range=0..1)
scala_iniziale_sezione_adim_3 = Panel("{1, 1, 0}")
scala_finale_sezione_adim_3 = Panel("{1, 1, 0}")
bridge_section_schedule_3 = BridgeSectionSchedule(
    Property=soletta_ritiro_estremità.Property_2,
    Start=progressiva_inizio_regola_mm_3,
    End=progressiva_fine_regola_mm_3,
    Family=famiglia_aste_della_regola_3,
    Group=list_length_3,
    Segment=concio_o_fascia_0_tutti_3,
    StartScale=scala_iniziale_sezione_adim_3,
    EndScale=scala_finale_sezione_adim_3)

# ---- group: Beam Property
nome_proprietà_9 = Panel("Soletta Q interna")
formulazione_elemento_trave_6 = ValueList({"Cable [1]": 1, "Truss [2]": 2, "Cutoff Bar [3]": 3, "Beam [5]": 5, "Connection [8]": 8}, selected="Beam [5]")
soletta_q_interna = BeamProperty(
    Name=nome_proprietà_9,
    Type=formulazione_elemento_trave_6,
    Section=sezione_fascia_interna,
    Material=cls_equivalente_q,
    Name_2=nome_proprietà_9,
    Type_2=formulazione_elemento_trave_6,
    Section_2=sezione_fascia_interna,
    Material_2=cls_equivalente_q,
    Release=1)  # -> Property, Property_2

# ---- group: Bridge Section Schedule
progressiva_inizio_regola_mm_4 = Slider(0, range=0..1)
progressiva_fine_regola_mm_4 = Slider(24000, range=0..48000)
famiglia_aste_della_regola_4 = Slider(8, range=0..16)
gruppo_aste_0_tutti_3 = Slider(1, range=0..2)
concio_o_fascia_0_tutti_4 = Slider(0, range=0..1)
scala_iniziale_sezione_adim_4 = Panel("{1, 1, 0}")
scala_finale_sezione_adim_4 = Panel("{1, 1, 0}")
bridge_section_schedule_4 = BridgeSectionSchedule(
    Property=soletta_q_estremità.Property_2,
    Start=progressiva_inizio_regola_mm_4,
    End=progressiva_fine_regola_mm_4,
    Family=famiglia_aste_della_regola_4,
    Group=gruppo_aste_0_tutti_3,
    Segment=concio_o_fascia_0_tutti_4,
    StartScale=scala_iniziale_sezione_adim_4,
    EndScale=scala_finale_sezione_adim_4)

progressiva_inizio_regola_mm_5 = Slider(0, range=0..1)
progressiva_fine_regola_mm_5 = Slider(24000, range=0..48000)
famiglia_aste_della_regola_5 = Slider(8, range=0..16)
concio_o_fascia_0_tutti_5 = Slider(0, range=0..1)
scala_iniziale_sezione_adim_5 = Panel("{1, 1, 0}")
scala_finale_sezione_adim_5 = Panel("{1, 1, 0}")
bridge_section_schedule_5 = BridgeSectionSchedule(
    Property=soletta_q_estremità.Property_2,
    Start=progressiva_inizio_regola_mm_5,
    End=progressiva_fine_regola_mm_5,
    Family=famiglia_aste_della_regola_5,
    Group=list_length_3,
    Segment=concio_o_fascia_0_tutti_5,
    StartScale=scala_iniziale_sezione_adim_5,
    EndScale=scala_finale_sezione_adim_5)

# ---- group: Beam Property
nome_proprietà_10 = Panel("Soletta G2 interna")
formulazione_elemento_trave_7 = ValueList({"Cable [1]": 1, "Truss [2]": 2, "Cutoff Bar [3]": 3, "Beam [5]": 5, "Connection [8]": 8}, selected="Beam [5]")
soletta_g2_interna = BeamProperty(
    Name=nome_proprietà_10,
    Type=formulazione_elemento_trave_7,
    Section=sezione_fascia_interna,
    Material=cls_equivalente_g2,
    Name_2=nome_proprietà_10,
    Type_2=formulazione_elemento_trave_7,
    Section_2=sezione_fascia_interna,
    Material_2=cls_equivalente_g2,
    Release=1)  # -> Property, Property_2

# ---- group: Bridge Section Schedule
progressiva_inizio_regola_mm_6 = Slider(0, range=0..1)
progressiva_fine_regola_mm_6 = Slider(24000, range=0..48000)
famiglia_aste_della_regola_6 = Slider(8, range=0..16)
gruppo_aste_0_tutti_4 = Slider(1, range=0..2)
concio_o_fascia_0_tutti_6 = Slider(0, range=0..1)
scala_iniziale_sezione_adim_6 = Panel("{1, 1, 0}")
scala_finale_sezione_adim_6 = Panel("{1, 1, 0}")
bridge_section_schedule_6 = BridgeSectionSchedule(
    Property=soletta_g2_estremità.Property_2,
    Start=progressiva_inizio_regola_mm_6,
    End=progressiva_fine_regola_mm_6,
    Family=famiglia_aste_della_regola_6,
    Group=gruppo_aste_0_tutti_4,
    Segment=concio_o_fascia_0_tutti_6,
    StartScale=scala_iniziale_sezione_adim_6,
    EndScale=scala_finale_sezione_adim_6)

progressiva_inizio_regola_mm_7 = Slider(0, range=0..1)
progressiva_fine_regola_mm_7 = Slider(24000, range=0..48000)
famiglia_aste_della_regola_7 = Slider(8, range=0..16)
concio_o_fascia_0_tutti_7 = Slider(0, range=0..1)
scala_iniziale_sezione_adim_7 = Panel("{1, 1, 0}")
scala_finale_sezione_adim_7 = Panel("{1, 1, 0}")
bridge_section_schedule_7 = BridgeSectionSchedule(
    Property=soletta_g2_estremità.Property_2,
    Start=progressiva_inizio_regola_mm_7,
    End=progressiva_fine_regola_mm_7,
    Family=famiglia_aste_della_regola_7,
    Group=list_length_3,
    Segment=concio_o_fascia_0_tutti_7,
    StartScale=scala_iniziale_sezione_adim_7,
    EndScale=scala_finale_sezione_adim_7)

# ----
list_length_4 = ListLength(List=super_element_2)
decompose_model = DecomposeModel(Model=build_model)  # -> Nodes, Beams, Plates

# ---- group: Bridge Model Audit
tolleranza_geometrica_mm = Slider(1e-06, range=0..1)
bridge_model_audit = BridgeModelAudit(Model=build_model, Tolerance=tolleranza_geometrica_mm)  # -> NoInputErrors, Severity, Code, Element, Description, Model

# ---- group: Bridge Family Property
famiglie_aste_da_assegnare_2 = Panel("""-1
8""")
familyproperty_2 = BridgeFamilyProperty(
    Property=[composite_beam_property.OnlySteelProperty, soletta_ritiro_interna.Property_2],
    Family=famiglie_aste_da_assegnare_2)

famiglie_aste_da_assegnare_3 = Panel("""-1
8""")
familyproperty_3 = BridgeFamilyProperty(Property=[composite_beam_property.OnlySteelProperty, soletta_q_interna.Property_2], Family=famiglie_aste_da_assegnare_3)

famiglie_aste_da_assegnare_4 = Panel("""-1
8""")
familyproperty_4 = BridgeFamilyProperty(Property=[composite_beam_property.OnlySteelProperty, soletta_g2_interna.Property_2], Family=famiglie_aste_da_assegnare_4)

# ---- group: Series
valore_iniziale_serie = Slider(1, range=0..2)
incremento_serie = Slider(1, range=0..2)
series = Series(Start=valore_iniziale_serie, Step=incremento_serie, Count=list_length_4)

# ---- group: Beam Filter
sistema_unità_di_misura_5 = ValueList({"kNm (m, kN, T, kPa, s, kJ, C)": 0, "SI (m, N, kg, Pa, s, J, C)": 1, "Nmm (mm, N, T, MPa, s, mJ, C)": 2, "PSI (in, lbf, lb, psi, s, btu, F)": 3}, selected="Nmm (mm, N, T, MPa, s, mJ, C)")
nomi_proprietà_da_selezionare = Panel("H1800 600x30 800x40 anima15 + soletta 2500x300OnlySteel")
beam_filter = BeamFilter(Beams=decompose_model.Beams, Units=sistema_unità_di_misura_5, PropertiesName=nomi_proprietà_da_selezionare)  # -> Beams, Others

# ----
panel_13 = Panel(bridge_model_audit.Description)
femmembers_2 = BridgeFEMMembers(
    BridgeGeometry=graticcio_acciaio_soletta_12_12_m_mesh.GrillageGeometry,
    FamilyProperties=familyproperty_2,
    SectionRules=[bridge_section_schedule_2, bridge_section_schedule_3])  # -> Beams, PhysicalIDs, Unassigned, Information
femmembers_3 = BridgeFEMMembers(
    BridgeGeometry=graticcio_acciaio_soletta_12_12_m_mesh.GrillageGeometry,
    FamilyProperties=familyproperty_3,
    SectionRules=[bridge_section_schedule_4, bridge_section_schedule_5])  # -> Beams, PhysicalIDs, Unassigned, Information
femmembers_4 = BridgeFEMMembers(
    BridgeGeometry=graticcio_acciaio_soletta_12_12_m_mesh.GrillageGeometry,
    FamilyProperties=familyproperty_4,
    SectionRules=[bridge_section_schedule_6, bridge_section_schedule_7])  # -> Beams, PhysicalIDs, Unassigned, Information
beam_override = BeamOverride(Beam=beam_filter.Beams, Property=composite_beam_property.NBeamSection)  # -> simplify(graft(Beam))

# ---- group: Beam Distributed Load
pa = Slider(-10, range=-10..10)
schema_distribuzione_carico = ValueList({"Uniform": 0, "Keystone": 1, "Triangular": 2, "Triangular at end 1 + Keystone": 3, "Keystone + Triangular at end 2": 4, "Triangular at ends + Keystone": 5, "Undefined": -1}, selected="Uniform")
direzione_carico = ValueList({"1": 0, "2": 1, "3": 2}, selected="2")
distanza_iniziale_relativa_a_l = Slider(0, range=0..1)
distanza_finale_relativa_b_l = Slider(0, range=0..1)
beam_distributed_load = BeamDistributedLoad(
    Beam=beam_filter.Beams,
    LoadCase=load_case,
    Type=schema_distribuzione_carico,
    Direction=direzione_carico,
    PA=pa,
    A=distanza_iniziale_relativa_a_l,
    B=distanza_finale_relativa_b_l)

# ----
beam_override_2 = BeamOverride(Beam=beam_filter.Beams, Property=composite_beam_property.N0BeamSection)
beam_override_3 = BeamOverride(Beam=beam_filter.Beams, Property=composite_beam_property.NRitiroBeamSection)

# ---- group: Beam Filter
sistema_unità_di_misura_6 = ValueList({"kNm (m, kN, T, kPa, s, kJ, C)": 0, "SI (m, N, kg, Pa, s, J, C)": 1, "Nmm (mm, N, T, MPa, s, mJ, C)": 2, "PSI (in, lbf, lb, psi, s, btu, F)": 3}, selected="Nmm (mm, N, T, MPa, s, mJ, C)")
nomi_proprietà_da_selezionare_2 = Panel("""Soletta RITIRO interna
Soletta RITIRO estremità""")
solo_fasce_cls_ritiro = BeamFilter(Beams=femmembers_2.Beams, Units=sistema_unità_di_misura_6, PropertiesName=nomi_proprietà_da_selezionare_2)  # -> Beams, Others

sistema_unità_di_misura_7 = ValueList({"kNm (m, kN, T, kPa, s, kJ, C)": 0, "SI (m, N, kg, Pa, s, J, C)": 1, "Nmm (mm, N, T, MPa, s, mJ, C)": 2, "PSI (in, lbf, lb, psi, s, btu, F)": 3}, selected="Nmm (mm, N, T, MPa, s, mJ, C)")
nomi_proprietà_da_selezionare_3 = Panel("""Soletta Q interna
Soletta Q estremità""")
solo_fasce_cls_q = BeamFilter(Beams=femmembers_3.Beams, Units=sistema_unità_di_misura_7, PropertiesName=nomi_proprietà_da_selezionare_3)  # -> Beams, Others

sistema_unità_di_misura_8 = ValueList({"kNm (m, kN, T, kPa, s, kJ, C)": 0, "SI (m, N, kg, Pa, s, J, C)": 1, "Nmm (mm, N, T, MPa, s, mJ, C)": 2, "PSI (in, lbf, lb, psi, s, btu, F)": 3}, selected="Nmm (mm, N, T, MPa, s, mJ, C)")
nomi_proprietà_da_selezionare_4 = Panel("""Soletta G2 interna
Soletta G2 estremità""")
solo_fasce_cls_g2 = BeamFilter(Beams=femmembers_4.Beams, Units=sistema_unità_di_misura_8, PropertiesName=nomi_proprietà_da_selezionare_4)  # -> Beams, Others

# ---- group: Build Model
nome_modello_fem_2 = Panel("G1_GETTO")
sistema_unità_di_misura_9 = ValueList({"kNm (m, kN, T, kPa, s, kJ, C)": 0, "SI (m, N, kg, Pa, s, J, C)": 1, "Nmm (mm, N, T, MPa, s, mJ, C)": 2, "PSI (in, lbf, lb, psi, s, btu, F)": 3}, selected="Nmm (mm, N, T, MPa, s, mJ, C)")
build_model_2 = BuildModel(
    Elements=flatten([beam_distributed_load, decompose_model.Nodes, beam_filter.Others]),
    Name=nome_modello_fem_2,
    Units=sistema_unità_di_misura_9)

# ---- group: Beam Distributed Load
pa_2 = Slider(-10, range=-10..10)
schema_distribuzione_carico_2 = ValueList({"Uniform": 0, "Keystone": 1, "Triangular": 2, "Triangular at end 1 + Keystone": 3, "Keystone + Triangular at end 2": 4, "Triangular at ends + Keystone": 5, "Undefined": -1}, selected="Uniform")
direzione_carico_2 = ValueList({"1": 0, "2": 1, "3": 2}, selected="2")
distanza_iniziale_relativa_a_l_2 = Slider(0, range=0..1)
distanza_finale_relativa_b_l_2 = Slider(0, range=0..1)
beam_distributed_load_2 = BeamDistributedLoad(
    Beam=simplify(beam_override),
    LoadCase=load_case_7,
    Type=schema_distribuzione_carico_2,
    Direction=direzione_carico_2,
    PA=pa_2,
    A=distanza_iniziale_relativa_a_l_2,
    B=distanza_finale_relativa_b_l_2)

pa_3 = Slider(-10, range=-10..10)
schema_distribuzione_carico_3 = ValueList({"Uniform": 0, "Keystone": 1, "Triangular": 2, "Triangular at end 1 + Keystone": 3, "Keystone + Triangular at end 2": 4, "Triangular at ends + Keystone": 5, "Undefined": -1}, selected="Uniform")
direzione_carico_3 = ValueList({"1": 0, "2": 1, "3": 2}, selected="2")
distanza_iniziale_relativa_a_l_3 = Slider(0, range=0..1)
distanza_finale_relativa_b_l_3 = Slider(0, range=0..1)
beam_distributed_load_3 = BeamDistributedLoad(
    Beam=beam_override_2,
    LoadCase=load_case_2,
    Type=schema_distribuzione_carico_3,
    Direction=direzione_carico_3,
    PA=pa_3,
    A=distanza_iniziale_relativa_a_l_3,
    B=distanza_finale_relativa_b_l_3)

# ---- group: Beam PreLoad
tipo_predeformazione_o_presollecitazione = ValueList({"Tension": 0, "Strain": 1}, selected="Strain")
beam_preload = BeamPreLoad(
    Beam=beam_override_3,
    LoadCase=load_case_4,
    Type=tipo_predeformazione_o_presollecitazione,
    Value=composite_shrinkage_actions.StrausPreStrain)

# ----
preview_bridghe_model = PreviewBridGHeModel(ModelElements=build_model_2, Settings=display_settings_3)

# ---- group: Bridge Analysis Cases
tipo_analisi_straus = ValueList({"Linear Static": 0, "Nonlinear Static": 1, "Staged analysis": 2}, selected="Linear Static")
nome_caso_fem_sorgente = ValueList({"G1_GETTO"}, selected="G1_GETTO")
straus_casi_richiesti_dalle_azioni = BridgeAnalysisCases(Model=build_model_2, RequiredCases=flatten(nome_caso_fem_sorgente), Solver=tipo_analisi_straus)  # -> AnalysisResults, Information

# ---- group: Beam Distributed Load
pa_4 = Slider(-2, range=-10..10)
schema_distribuzione_carico_4 = ValueList({"Uniform": 0, "Keystone": 1, "Triangular": 2, "Triangular at end 1 + Keystone": 3, "Keystone + Triangular at end 2": 4, "Triangular at ends + Keystone": 5, "Undefined": -1}, selected="Uniform")
direzione_carico_4 = ValueList({"1": 0, "2": 1, "3": 2}, selected="2")
distanza_iniziale_relativa_a_l_4 = Slider(0, range=0..1)
distanza_finale_relativa_b_l_4 = Slider(0, range=0..1)
beam_distributed_load_4 = BeamDistributedLoad(
    Beam=beam_distributed_load_2,
    LoadCase=load_case_8,
    Type=schema_distribuzione_carico_4,
    Direction=direzione_carico_4,
    PA=pa_4,
    A=distanza_iniziale_relativa_a_l_4,
    B=distanza_finale_relativa_b_l_4)

# ---- group: Beam Gradient Load
gradiente_deformazione_asse_1 = Slider(0, range=0..1)
beam_gradient_load = BeamGradientLoad(
    Beam=beam_preload,
    LoadCase=load_case_5,
    Axis1=gradiente_deformazione_asse_1,
    Axis2=composite_shrinkage_actions.Axis2ThermalGradient)

# ---- group: Beam Distributed Load
pa_5 = Slider(-5, range=-10..10)
schema_distribuzione_carico_5 = ValueList({"Uniform": 0, "Keystone": 1, "Triangular": 2, "Triangular at end 1 + Keystone": 3, "Keystone + Triangular at end 2": 4, "Triangular at ends + Keystone": 5, "Undefined": -1}, selected="Uniform")
direzione_carico_5 = ValueList({"1": 0, "2": 1, "3": 2}, selected="1")
distanza_iniziale_relativa_a_l_5 = Slider(0, range=0..1)
distanza_finale_relativa_b_l_5 = Slider(0, range=0..1)
beam_distributed_load_5 = BeamDistributedLoad(
    Beam=beam_distributed_load_3,
    LoadCase=load_case_3,
    Type=schema_distribuzione_carico_5,
    Direction=direzione_carico_5,
    PA=pa_5,
    A=distanza_iniziale_relativa_a_l_5,
    B=distanza_finale_relativa_b_l_5)

# ---- group: Straus R3 Analysis
percorso_modello_straus = Panel("C:\Users\g.pacini\Documents\Repository\BridGHe\example\99-Ponte completo GPC\REV004\calcoli\G1.st7")
aggiornamento_automatico = BooleanToggle(False)
straus_r3_analysis = StrausR3Analysis(
    Model=build_model_2,
    Solver=tipo_analisi_straus,
    AnalysisResults=flatten([casi_straus_da_importare, straus_casi_richiesti_dalle_azioni.AnalysisResults]),
    OutputPath=percorso_modello_straus,
    KeepRunning=aggiornamento_automatico,
    ElementGuids="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")

# ---- group: Build Model
nome_modello_fem_3 = Panel("Q_TRAFFICO")
sistema_unità_di_misura_10 = ValueList({"kNm (m, kN, T, kPa, s, kJ, C)": 0, "SI (m, N, kg, Pa, s, J, C)": 1, "Nmm (mm, N, T, MPa, s, mJ, C)": 2, "PSI (in, lbf, lb, psi, s, btu, F)": 3}, selected="Nmm (mm, N, T, MPa, s, mJ, C)")
build_model_3 = BuildModel(
    Elements=flatten([beam_distributed_load_5, decompose_model.Nodes, beam_filter.Others, solo_fasce_cls_q.Beams, rigidlinks.Elements]),
    Name=nome_modello_fem_3,
    Units=sistema_unità_di_misura_10)

nome_modello_fem_4 = Panel("RITIRO_FEM")
sistema_unità_di_misura_11 = ValueList({"kNm (m, kN, T, kPa, s, kJ, C)": 0, "SI (m, N, kg, Pa, s, J, C)": 1, "Nmm (mm, N, T, MPa, s, mJ, C)": 2, "PSI (in, lbf, lb, psi, s, btu, F)": 3}, selected="Nmm (mm, N, T, MPa, s, mJ, C)")
build_model_4 = BuildModel(
    Elements=flatten([beam_gradient_load, decompose_model.Nodes, beam_filter.Others, solo_fasce_cls_ritiro.Beams, rigidlinks.Elements]),
    Name=nome_modello_fem_4,
    Units=sistema_unità_di_misura_11,
    LoadCombinations=load_combination)

# ---- group: Beam Distributed Load
pa_6 = Slider(-1, range=-10..10)
schema_distribuzione_carico_6 = ValueList({"Uniform": 0, "Keystone": 1, "Triangular": 2, "Triangular at end 1 + Keystone": 3, "Keystone + Triangular at end 2": 4, "Triangular at ends + Keystone": 5, "Undefined": -1}, selected="Uniform")
direzione_carico_6 = ValueList({"1": 0, "2": 1, "3": 2}, selected="2")
distanza_iniziale_relativa_a_l_6 = Slider(0, range=0..1)
distanza_finale_relativa_b_l_6 = Slider(0, range=0..1)
beam_distributed_load_6 = BeamDistributedLoad(
    Beam=beam_distributed_load_4,
    LoadCase=load_case_9,
    Type=schema_distribuzione_carico_6,
    Direction=direzione_carico_6,
    PA=pa_6,
    A=distanza_iniziale_relativa_a_l_6,
    B=distanza_finale_relativa_b_l_6)

# ----
preview_bridghe_model_2 = PreviewBridGHeModel(ModelElements=build_model_3, Settings=display_settings)
preview_bridghe_model_3 = PreviewBridGHeModel(ModelElements=build_model_4, Settings=display_settings_2)

# ---- group: Bridge Action
identificativo_azione = Panel("G1")
comportamento_sezione_nella_fase = ValueList({"Only Steel": 0, "Long Term": 1, "Short Term": 2}, selected="Only Steel")
bridge_action = BridgeAction(
    ActionID=identificativo_azione,
    Model=straus_r3_analysis,
    Case=nome_caso_fem_sorgente,
    Behavior=comportamento_sezione_nella_fase)

# ---- group: Super Element Filter
id_trave_da_selezionare = Panel("G1")
super_element_filter = SuperElementFilter(BridGHeModel=straus_r3_analysis, SuperElement=id_trave_da_selezionare)

# ---- group: Build Model
nome_modello_fem_5 = Panel("G2_PERMANENTI")
sistema_unità_di_misura_12 = ValueList({"kNm (m, kN, T, kPa, s, kJ, C)": 0, "SI (m, N, kg, Pa, s, J, C)": 1, "Nmm (mm, N, T, MPa, s, mJ, C)": 2, "PSI (in, lbf, lb, psi, s, btu, F)": 3}, selected="Nmm (mm, N, T, MPa, s, mJ, C)")
build_model_5 = BuildModel(
    Elements=flatten([beam_distributed_load_6, decompose_model.Nodes, beam_filter.Others, solo_fasce_cls_g2.Beams, rigidlinks.Elements]),
    Name=nome_modello_fem_5,
    Units=sistema_unità_di_misura_12,
    LoadCombinations=load_combination_2)

# ---- group: Bridge Analysis Cases
nome_caso_fem_sorgente_2 = ValueList({"Q_TRAFFICO", "WIND_1"}, selected="Q_TRAFFICO")
tipo_analisi_straus_2 = ValueList({"Linear Static": 0, "Nonlinear Static": 1, "Staged analysis": 2}, selected="Linear Static")
nome_caso_fem_sorgente_3 = Panel("WIND_1")
straus_casi_richiesti_dalle_azioni_2 = BridgeAnalysisCases(
    Model=build_model_3,
    RequiredCases=flatten([nome_caso_fem_sorgente_2, nome_caso_fem_sorgente_3]),
    Solver=tipo_analisi_straus_2)  # -> AnalysisResults, Information

tipo_analisi_straus_3 = ValueList({"Linear Static": 0, "Nonlinear Static": 1, "Staged analysis": 2}, selected="Linear Static")
nome_caso_fem_sorgente_4 = Panel("RITIRO_FEM")
straus_casi_richiesti_dalle_azioni_3 = BridgeAnalysisCases(Model=build_model_4, RequiredCases=flatten(nome_caso_fem_sorgente_4), Solver=tipo_analisi_straus_3)  # -> AnalysisResults, Information

# ----
preview_bridghe_model_4 = PreviewBridGHeModel(ModelElements=build_model_5, Settings=display_settings_4)

# ---- group: Bridge Phase
section_state = ValueList({"Only Steel": 0, "Composite": 1, "Concrete Excluded": 2}, selected="Only Steel")
numero_ordine_fase = Slider(10, range=0..20)
bridge_phase = BridgePhase(Number=numero_ordine_fase, Name=nome_caso_fem_sorgente, SectionState=section_state, Actions=flatten(bridge_action))

# ---- group: Bridge Analysis Cases
tipo_analisi_straus_4 = ValueList({"Linear Static": 0, "Nonlinear Static": 1, "Staged analysis": 2}, selected="Linear Static")
nome_caso_fem_sorgente_5 = ValueList({"G2_PERMANENTI"}, selected="G2_PERMANENTI")
straus_casi_richiesti_dalle_azioni_4 = BridgeAnalysisCases(Model=build_model_5, RequiredCases=flatten(nome_caso_fem_sorgente_5), Solver=tipo_analisi_straus_4)  # -> AnalysisResults, Information

# ---- group: Build Model
nome_modello_fem_vuoto = Text("")
sistema_unità_di_misura_13 = ValueList({"kNm (m, kN, T, kPa, s, kJ, C)": 0, "SI (m, N, kg, Pa, s, J, C)": 1, "Nmm (mm, N, T, MPa, s, mJ, C)": 2, "PSI (in, lbf, lb, psi, s, btu, F)": 3}, selected="Nmm (mm, N, T, MPa, s, mJ, C)")
build_model_6 = BuildModel(Elements=flatten(super_element_filter), Name=nome_modello_fem_vuoto, Units=sistema_unità_di_misura_13)

# ---- group: Straus R3 Analysis
casi_straus_da_importare_3 = Panel("""Q_TRAFFICO
WIND_1""")
percorso_modello_straus_2 = Panel("C:\Users\g.pacini\Documents\Repository\BridGHe\example\99-Ponte completo GPC\REV004\calcoli\Q.st7")
aggiornamento_automatico_2 = BooleanToggle(False)
straus_r3_analysis_2 = StrausR3Analysis(
    Model=build_model_3,
    Solver=tipo_analisi_straus_2,
    AnalysisResults=flatten([casi_straus_da_importare_3, straus_casi_richiesti_dalle_azioni_2.AnalysisResults]),
    OutputPath=percorso_modello_straus_2,
    KeepRunning=aggiornamento_automatico_2,
    ElementGuids="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")

results_2 = ValueList({"Dead", "RITIRO_FEM_GRAD", "RITIRO_FEM_LIN", "RITIRO_FEM"}, selected="RITIRO_FEM")
percorso_modello_straus_3 = Panel("C:\Users\g.pacini\Documents\Repository\BridGHe\example\99-Ponte completo GPC\REV004\calcoli\RITIRO.st7")
aggiornamento_automatico_3 = BooleanToggle(False)
straus_r3_analysis_3 = StrausR3Analysis(
    Model=build_model_4,
    Solver=tipo_analisi_straus_3,
    AnalysisResults=flatten([results_2, straus_casi_richiesti_dalle_azioni_3.AnalysisResults]),
    OutputPath=percorso_modello_straus_3,
    KeepRunning=aggiornamento_automatico_3,
    ElementGuids="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")

percorso_modello_straus_4 = Panel("C:\Users\g.pacini\Documents\Repository\BridGHe\example\99-Ponte completo GPC\REV004\calcoli\G2.st7")
aggiornamento_automatico_4 = BooleanToggle(False)
straus_r3_analysis_4 = StrausR3Analysis(
    Model=build_model_5,
    Solver=tipo_analisi_straus_4,
    AnalysisResults=flatten([casi_straus_da_importare_2, straus_casi_richiesti_dalle_azioni_4.AnalysisResults]),
    OutputPath=percorso_modello_straus_4,
    KeepRunning=aggiornamento_automatico_4,
    ElementGuids="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")

# ---- group: Bridge Action
identificativo_azione_2 = Panel("Q")
comportamento_sezione_nella_fase_2 = ValueList({"Only Steel": 0, "Long Term": 1, "Short Term": 2}, selected="Short Term")
bridge_action_2 = BridgeAction(
    ActionID=identificativo_azione_2,
    Model=straus_r3_analysis_2,
    Case=nome_caso_fem_sorgente_2,
    Behavior=comportamento_sezione_nella_fase_2)

# ---- group: Super Element Filter
id_trave_da_selezionare_2 = Panel("G1")
super_element_filter_2 = SuperElementFilter(BridGHeModel=straus_r3_analysis_2, SuperElement=id_trave_da_selezionare_2)

# ---- group: Bridge Action
identificativo_azione_3 = Panel("WIND")
comportamento_sezione_nella_fase_3 = Slider(2, range=0..4)
wind_dal_modello_q = BridgeAction(
    ActionID=identificativo_azione_3,
    Model=straus_r3_analysis_2,
    Case=nome_caso_fem_sorgente_3,
    Behavior=comportamento_sezione_nella_fase_3)

# ---- group: Bridge Shrinkage Action
identificativo_azione_4 = Panel("RITIRO")
solo_effetto_primario = BooleanToggle(False)
risposta_sezione_allo_strain = Slider(0, range=0..1)
bridge_shrinkage_action = BridgeShrinkageAction(
    ActionID=identificativo_azione_4,
    Model=straus_r3_analysis_3,
    Case=nome_caso_fem_sorgente_4,
    StrainIncrement=ritiro_da_rh_geometria_ed_età.Εcs,
    PrimaryOnly=solo_effetto_primario,
    Response=risposta_sezione_allo_strain)

# ----
merge_3 = Merge(
    Data1=flatten(straus_r3_analysis),
    Data2=flatten(straus_r3_analysis_4),
    Data3=flatten(straus_r3_analysis_2),
    Data4=flatten(straus_r3_analysis_3))

# ---- group: Bridge Action
identificativo_azione_5 = Panel("G2")
comportamento_sezione_nella_fase_4 = ValueList({"Only Steel": 0, "Long Term": 1, "Short Term": 2}, selected="Long Term")
bridge_action_3 = BridgeAction(
    ActionID=identificativo_azione_5,
    Model=straus_r3_analysis_4,
    Case=nome_caso_fem_sorgente_5,
    Behavior=comportamento_sezione_nella_fase_4)

# ---- group: Super Element Filter
id_trave_da_selezionare_3 = Panel("G1")
super_element_filter_3 = SuperElementFilter(BridGHeModel=straus_r3_analysis_4, SuperElement=id_trave_da_selezionare_3)

# ---- group: Build Model
nome_modello_fem_vuoto_2 = Text("")
sistema_unità_di_misura_14 = ValueList({"kNm (m, kN, T, kPa, s, kJ, C)": 0, "SI (m, N, kg, Pa, s, J, C)": 1, "Nmm (mm, N, T, MPa, s, mJ, C)": 2, "PSI (in, lbf, lb, psi, s, btu, F)": 3}, selected="Nmm (mm, N, T, MPa, s, mJ, C)")
build_model_7 = BuildModel(Elements=flatten(super_element_filter_2), Name=nome_modello_fem_vuoto_2, Units=sistema_unità_di_misura_14)

# ---- group: Bridge Phase
section_state_2 = ValueList({"Only Steel": 0, "Composite": 1, "Concrete Excluded": 2}, selected="Composite")
numero_ordine_fase_2 = Slider(40, range=0..80)
bridge_phase_2 = BridgePhase(
    Number=numero_ordine_fase_2,
    Name=nome_caso_fem_sorgente_2,
    SectionState=section_state_2,
    Actions=flatten([bridge_action_2, wind_dal_modello_q]))

numero_ordine_fase_3 = Slider(30, range=0..60)
nome_fase_costruttiva = Panel("Ritiro primario e secondario")
section_state_3 = ValueList({"Only Steel": 0, "Composite": 1, "Concrete Excluded": 2}, selected="Composite")
bridge_phase_3 = BridgePhase(
    Number=numero_ordine_fase_3,
    Name=nome_fase_costruttiva,
    SectionState=section_state_3,
    Actions=flatten(bridge_shrinkage_action))

section_state_4 = ValueList({"Only Steel": 0, "Composite": 1, "Concrete Excluded": 2}, selected="Composite")
numero_ordine_fase_4 = Slider(20, range=0..40)
bridge_phase_4 = BridgePhase(
    Number=numero_ordine_fase_4,
    Name=nome_caso_fem_sorgente_5,
    SectionState=section_state_4,
    Actions=flatten(bridge_action_3))

# ---- group: Build Model
nome_modello_fem_vuoto_3 = Text("")
sistema_unità_di_misura_15 = ValueList({"kNm (m, kN, T, kPa, s, kJ, C)": 0, "SI (m, N, kg, Pa, s, J, C)": 1, "Nmm (mm, N, T, MPa, s, mJ, C)": 2, "PSI (in, lbf, lb, psi, s, btu, F)": 3}, selected="Nmm (mm, N, T, MPa, s, mJ, C)")
build_model_8 = BuildModel(Elements=flatten(super_element_filter_3), Name=nome_modello_fem_vuoto_3, Units=sistema_unità_di_misura_15)

# ----
merge_4 = Merge(Data1=flatten(bridge_phase), Data2=flatten(bridge_phase_4), Data4=flatten(bridge_phase_3), Data5=flatten(bridge_phase_2))
bridge_phase_table = BridgePhaseTable(Phases=flatten([bridge_phase, bridge_phase_4, bridge_phase_3, bridge_phase_2]))  # -> Phases, Number, Name, Day, SectionState, ActionID, Behavior, Source, Case, Strain

# ---- group: Bridge Combination Excel
percorso_excel_combinazioni = Panel("Combinazioni_REV004.xlsx")
operazione_excel = Slider(0, range=0..1)
righe_nel_template_combinazioni = Slider(20, range=0..40)
sovrascrivi_file_esistente = BooleanToggle(False)
bridge_combination_excel = BridgeCombinationExcel(
    Models=flatten([straus_r3_analysis, straus_r3_analysis_4, straus_r3_analysis_2, straus_r3_analysis_3]),
    Phases=flatten([bridge_phase, bridge_phase_4, bridge_phase_3, bridge_phase_2]),
    File=percorso_excel_combinazioni,
    Mode=operazione_excel,
    Rows=righe_nel_template_combinazioni,
    Overwrite=sovrascrivi_file_esistente)  # -> File, Table, ActionIDs, Summary

percorso_excel_combinazioni_2 = Panel("Combinazioni_REV004.xlsx")
operazione_excel_2 = Slider(1, range=0..2)
righe_nel_template_combinazioni_2 = Slider(20, range=0..40)
sovrascrivi_file_esistente_2 = BooleanToggle(False)
bridge_combination_excel_2 = BridgeCombinationExcel(
    Models=flatten([straus_r3_analysis, straus_r3_analysis_4, straus_r3_analysis_2, straus_r3_analysis_3]),
    Phases=flatten([bridge_phase, bridge_phase_4, bridge_phase_3, bridge_phase_2]),
    File=percorso_excel_combinazioni_2,
    Mode=operazione_excel_2,
    Rows=righe_nel_template_combinazioni_2,
    Overwrite=sovrascrivi_file_esistente_2)  # -> File, Table, ActionIDs, Summary

# ----
panel_14 = Panel(bridge_phase_table.SectionState)

# ---- group: Build BridGHe Model
metodo_assemblaggio_fasi = Slider(0, range=0..1)
ammetti_aste_aggiuntive_nelle_fasi = BooleanToggle(True)
build_bridghe_model = BuildBridGHeModel(
    Models=flatten([straus_r3_analysis, straus_r3_analysis_4, straus_r3_analysis_2, straus_r3_analysis_3]),
    Phases=flatten([bridge_phase, bridge_phase_4, bridge_phase_3, bridge_phase_2]),
    Combinations=bridge_combination_excel_2.Table,
    Calculation=metodo_assemblaggio_fasi,
    AdditionalPhaseMembers=ammetti_aste_aggiuntive_nelle_fasi)  # -> Model, Phases, Diagnostics

# ----
panel_15 = Panel(build_bridghe_model.Diagnostics)

# ---- group: Super Element Filter
id_trave_da_selezionare_4 = Panel("G1")
super_element_filter_4 = SuperElementFilter(BridGHeModel=build_bridghe_model.Model, SuperElement=id_trave_da_selezionare_4)

id_trave_da_selezionare_5 = Panel("G2")
trave_g2 = SuperElementFilter(BridGHeModel=build_bridghe_model.Model, SuperElement=id_trave_da_selezionare_5)

# ----
composite_beam = CompositeBeam(Beam=super_element_filter_4, SectionStart=composite_beam_property.CompositeSection)
misto_g2 = CompositeBeam(Beam=trave_g2, SectionStart=composite_beam_property.CompositeSection)
preview_bridghe_model_5 = PreviewBridGHeModel(ModelElements=composite_beam, Settings=display_settings_5)

# ---- group: Super Element Check
instabilità_locale_anima = BooleanToggle(False)
instabilità_locale_ala_superiore = BooleanToggle(False)
instabilità_locale_ala_inferiore = BooleanToggle(False)
super_element_check = SuperElementCheck(
    BridGHeModel=build_bridghe_model.Model,
    SuperElementBeam=composite_beam,
    WebLocalInstability=instabilità_locale_anima,
    TopFlangeLocalInstability=instabilità_locale_ala_superiore,
    BottomFlangeLocalInstability=instabilità_locale_ala_inferiore)  # -> TensionCheck, TauB, TensionForces

instabilità_locale_anima_2 = BooleanToggle(True)
instabilità_locale_ala_superiore_2 = BooleanToggle(True)
instabilità_locale_ala_inferiore_2 = BooleanToggle(True)
verifiche_g2 = SuperElementCheck(
    BridGHeModel=build_bridghe_model.Model,
    SuperElementBeam=misto_g2,
    WebLocalInstability=instabilità_locale_anima_2,
    TopFlangeLocalInstability=instabilità_locale_ala_superiore_2,
    BottomFlangeLocalInstability=instabilità_locale_ala_inferiore_2)  # -> TensionCheck, TauB, TensionForces

# ---- group: Bridge Stress Plot
grandezza_da_rappresentare = ValueList({"σ1 concrete": 0, "σ2 rebar": 1, "σ4 concrete": 2, "σ5 steel": 3, "σ6 steel": 4, "σ7 steel": 5, "σ8 steel": 6, "τ6": 7, "τ7": 8, "σ6 equivalent": 9, "σ7 equivalent": 10, "ε1 concrete": 11, "ε8 steel": 12}, selected="σ5 steel")
mostra_combinazioni_minime_e_massime = BooleanToggle(True)
titolo_del_grafico = Panel("Trave 1 - Tensioni acciaio sigma 5")
aggiornamento_automatico_5 = BooleanToggle(True)
bridge_stress_plot = BridgeStressPlot(
    BridGHeModel=build_bridghe_model.Model,
    SuperElementBeam=composite_beam,
    Results=super_element_check.TensionCheck,
    Quantity=grandezza_da_rappresentare,
    ShowMinMaxCombo=mostra_combinazioni_minime_e_massime,
    GraphicTitle=titolo_del_grafico,
    KeepRunning=aggiornamento_automatico_5)  # -> SVG, File, Minimum, Maximum

# ---- group: Bridge Force Plot
grandezza_da_rappresentare_2 = ValueList({"N": 0, "Vx": 1, "Vy": 2, "T": 3, "Mx": 4, "My": 5}, selected="Mx")
mostra_combinazioni_minime_e_massime_2 = BooleanToggle(True)
titolo_del_grafico_2 = Panel("Trave 1 - Momento Mx")
aggiornamento_automatico_6 = BooleanToggle(True)
bridge_force_plot = BridgeForcePlot(
    BridGHeModel=build_bridghe_model.Model,
    SuperElementBeam=composite_beam,
    Results=super_element_check.TensionForces,
    Quantity=grandezza_da_rappresentare_2,
    ShowMinMaxCombo=mostra_combinazioni_minime_e_massime_2,
    GraphicTitle=titolo_del_grafico_2,
    KeepRunning=aggiornamento_automatico_6)  # -> SVG, File, Minimum, Maximum

# ----
pioli_sulle_azioni_di_fase = BridgeDetailCheck(SectionResult=super_element_check.TensionCheck, Studs=pioli_2x22_passo200, Options=ultimate_solo_dimostrazione)  # -> SectionResult, Check, Demand, Resistance, Units, Ratio, Status, Warnings
composite_section_linear_tension_results = CompositeSectionLinearTensionResults(LinearTensionResults=super_element_check.TensionCheck)  # -> Point1_ConcreteEpsilon, Point1_ConcreteSigma, Point2_RebarSigma, Point3_RebarSigma, Point4_ConcreteSigma, Point5_SteelSigma, Point6_SteelSigma, Point6_SteelTau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
pioli_g2 = BridgeDetailCheck(SectionResult=verifiche_g2.TensionCheck, Studs=pioli_2x22_passo200, Options=ultimate_solo_dimostrazione)  # -> SectionResult, Check, Demand, Resistance, Units, Ratio, Status, Warnings

# ---- group: Bridge Force Plot
grandezza_da_rappresentare_3 = ValueList({"N": 0, "Vx": 1, "Vy": 2, "T": 3, "Mx": 4, "My": 5}, selected="Mx")
mostra_combinazioni_minime_e_massime_3 = BooleanToggle(True)
titolo_del_grafico_3 = Panel("Trave 2 - Momento Mx")
aggiornamento_automatico_7 = BooleanToggle(True)
bridge_force_plot_g2 = BridgeForcePlot(
    BridGHeModel=build_bridghe_model.Model,
    SuperElementBeam=misto_g2,
    Results=verifiche_g2.TensionForces,
    Quantity=grandezza_da_rappresentare_3,
    ShowMinMaxCombo=mostra_combinazioni_minime_e_massime_3,
    GraphicTitle=titolo_del_grafico_3,
    KeepRunning=aggiornamento_automatico_7)  # -> SVG, File, Minimum, Maximum

# ---- group: Bridge Stress Plot
grandezza_da_rappresentare_4 = ValueList({"σ1 concrete": 0, "σ2 rebar": 1, "σ4 concrete": 2, "σ5 steel": 3, "σ6 steel": 4, "σ7 steel": 5, "σ8 steel": 6, "τ6": 7, "τ7": 8, "σ6 equivalent": 9, "σ7 equivalent": 10, "ε1 concrete": 11, "ε8 steel": 12}, selected="σ5 steel")
mostra_combinazioni_minime_e_massime_4 = BooleanToggle(True)
titolo_del_grafico_4 = Panel("Trave 2 - Tensioni acciaio sigma 5")
aggiornamento_automatico_8 = BooleanToggle(True)
bridge_stress_plot_g2 = BridgeStressPlot(
    BridGHeModel=build_bridghe_model.Model,
    SuperElementBeam=misto_g2,
    Results=verifiche_g2.TensionCheck,
    Quantity=grandezza_da_rappresentare_4,
    ShowMinMaxCombo=mostra_combinazioni_minime_e_massime_4,
    GraphicTitle=titolo_del_grafico_4,
    KeepRunning=aggiornamento_automatico_8)  # -> SVG, File, Minimum, Maximum

# ---- group: Bridge Plot Preview
indice_grafico_da_visualizzare = Slider(0, range=0..1)
larghezza_anteprima_px = Slider(600, range=0..1200)
bridge_plot_preview = BridgePlotPreview(SVG=flatten(bridge_stress_plot.SVG), Index=indice_grafico_da_visualizzare, Width=larghezza_anteprima_px)

indice_grafico_da_visualizzare_2 = Slider(0, range=0..1)
larghezza_anteprima_px_2 = Slider(600, range=0..1200)
bridge_plot_preview_2 = BridgePlotPreview(SVG=flatten(bridge_force_plot.SVG), Index=indice_grafico_da_visualizzare_2, Width=larghezza_anteprima_px_2)

# ----
rapporti_stesso_ordine = Panel(pioli_sulle_azioni_di_fase.Ratio)
controlli = Panel(pioli_sulle_azioni_di_fase.Check)
pioli_per_stazione_e_combo = BridgeStudResults(SectionResult=pioli_sulle_azioni_di_fase.SectionResult)  # -> ConnectionFlow, ForcePerStud, ResistancePerStud, ResistancePerLength, ForceRatio, Phase, PhaseFlow, Warnings
sigma_cls_superiore_mpa = Panel(composite_section_linear_tension_results.Point1_ConcreteSigma)

# ---- group: Bridge Detail Stations
versore_verticale_di_riferimento = Panel("{0, 0, 1}")
tolleranza_geometrica_mm_2 = Slider(1e-06, range=0..1)
intermedi_passo_2_m = Point([Point(2000, -1500, -1359.318631), Point(4000, -1500, -1359.318631), Point(6000, -1500, -1359.318631), Point(8000, -1500, -1359.318631), Point(10000, -1500, -1359.318631), Point(14000, -1500, -1359.318631), Point(16000, -1500, -1359.318631), Point(18000, -1500, -1359.318631), Point(20000, -1500, -1359.318631), Point(22000, -1500, -1359.318631)])
sezioni_irrigiditori_intermedi = BridgeDetailStations(
    Model=build_bridghe_model.Model,
    Results=pioli_sulle_azioni_di_fase.SectionResult,
    Locations=intermedi_passo_2_m,
    Up=versore_verticale_di_riferimento,
    Tolerance=tolleranza_geometrica_mm_2)  # -> Results, CompressionKN, SignedReactionKN, EndType, Points

# ---- group: Bridge Result Labels
format = ValueList({"Completa": 0, "Trave e stazione": 1, "Combinazione": 2, "Fase": 3}, selected="Completa")
bridge_result_labels = BridgeResultLabels(Results=pioli_sulle_azioni_di_fase.SectionResult, Format=format)

# ----
sigma_armatura_superiore_mpa = Panel(composite_section_linear_tension_results.Point2_RebarSigma)
sigma_armatura_inferiore_mpa = Panel(composite_section_linear_tension_results.Point3_RebarSigma)

# ---- group: Bridge Detail Stations
versore_verticale_di_riferimento_2 = Panel("{0, 0, 1}")
tolleranza_geometrica_mm_3 = Slider(1e-06, range=0..1)
appoggi_sugli_assi_fem = Point([Point(0, -1500, -1359.318631), Point(12000, -1500, -1359.318631), Point(24000, -1500, -1359.318631)])
appoggi_e_reazioni_reali = BridgeDetailStations(
    Model=build_bridghe_model.Model,
    Results=pioli_sulle_azioni_di_fase.SectionResult,
    Locations=appoggi_sugli_assi_fem,
    Phases=[bridge_phase, bridge_phase_4, bridge_phase_3, bridge_phase_2],
    Up=versore_verticale_di_riferimento_2,
    Tolerance=tolleranza_geometrica_mm_3)  # -> Results, CompressionKN, SignedReactionKN, EndType, Points

# ----
sigma_acciaio_inferiore_mpa = Panel(composite_section_linear_tension_results.Point8_SteelSigma)

# ---- group: Bridge Stud Plot
grandezza_da_rappresentare_5 = ValueList({"Connection flow": 0, "Force per stud": 1, "Resistance per stud": 2, "Resistance per length": 3, "Stud force ratio": 4, "Stud demand / resistance": 5, "Flow demand / resistance": 6}, selected="Stud demand / resistance")
mostra_combinazioni_minime_e_massime_5 = BooleanToggle(True)
titolo_del_grafico_5 = Panel("Trave 1 - Pioli Ed e Rd")
aggiornamento_automatico_9 = BooleanToggle(True)
bridge_stud_plot = BridgeStudPlot(
    BridGHeModel=build_bridghe_model.Model,
    SuperElementBeam=composite_beam,
    Results=pioli_sulle_azioni_di_fase.SectionResult,
    Quantity=grandezza_da_rappresentare_5,
    ShowMinMaxCombo=mostra_combinazioni_minime_e_massime_5,
    GraphicTitle=titolo_del_grafico_5,
    KeepRunning=aggiornamento_automatico_9)  # -> SVG, File, Minimum, Maximum

# ---- group: Bridge Detail Stations
versore_verticale_di_riferimento_3 = Panel("{0, 0, 1}")
tolleranza_geometrica_mm_4 = Slider(1e-06, range=0..1)
intermedi_g2 = Point([Point(2000, 1500, -1359.318631), Point(4000, 1500, -1359.318631), Point(6000, 1500, -1359.318631), Point(8000, 1500, -1359.318631), Point(10000, 1500, -1359.318631), Point(14000, 1500, -1359.318631), Point(16000, 1500, -1359.318631), Point(18000, 1500, -1359.318631), Point(20000, 1500, -1359.318631), Point(22000, 1500, -1359.318631)])
intermedi_g2_2 = BridgeDetailStations(
    Model=build_bridghe_model.Model,
    Results=pioli_g2.SectionResult,
    Locations=intermedi_g2,
    Up=versore_verticale_di_riferimento_3,
    Tolerance=tolleranza_geometrica_mm_4)  # -> Results, CompressionKN, SignedReactionKN, EndType, Points

versore_verticale_di_riferimento_4 = Panel("{0, 0, 1}")
tolleranza_geometrica_mm_5 = Slider(1e-06, range=0..1)
appoggi_g2 = Point([Point(0, 1500, -1359.318631), Point(12000, 1500, -1359.318631), Point(24000, 1500, -1359.318631)])
appoggi_g2_2 = BridgeDetailStations(
    Model=build_bridghe_model.Model,
    Results=pioli_g2.SectionResult,
    Locations=appoggi_g2,
    Phases=[bridge_phase, bridge_phase_4, bridge_phase_3, bridge_phase_2],
    Up=versore_verticale_di_riferimento_4,
    Tolerance=tolleranza_geometrica_mm_5)  # -> Results, CompressionKN, SignedReactionKN, EndType, Points

# ---- group: Bridge Plot Preview
indice_grafico_da_visualizzare_3 = Slider(0, range=0..1)
larghezza_anteprima_px_3 = Slider(600, range=0..1200)
bridge_plot_preview_3 = BridgePlotPreview(SVG=flatten(bridge_force_plot_g2.SVG), Index=indice_grafico_da_visualizzare_3, Width=larghezza_anteprima_px_3)

indice_grafico_da_visualizzare_4 = Slider(0, range=0..1)
larghezza_anteprima_px_4 = Slider(600, range=0..1200)
bridge_plot_preview_4 = BridgePlotPreview(SVG=flatten(bridge_stress_plot_g2.SVG), Index=indice_grafico_da_visualizzare_4, Width=larghezza_anteprima_px_4)

# ---- group: Bridge Stud Plot
grandezza_da_rappresentare_6 = ValueList({"Connection flow": 0, "Force per stud": 1, "Resistance per stud": 2, "Resistance per length": 3, "Stud force ratio": 4, "Stud demand / resistance": 5, "Flow demand / resistance": 6}, selected="Stud demand / resistance")
mostra_combinazioni_minime_e_massime_6 = BooleanToggle(True)
titolo_del_grafico_6 = Panel("Trave 2 - Pioli Ed e Rd")
aggiornamento_automatico_10 = BooleanToggle(True)
bridge_stud_plot_g2 = BridgeStudPlot(
    BridGHeModel=build_bridghe_model.Model,
    SuperElementBeam=misto_g2,
    Results=pioli_g2.SectionResult,
    Quantity=grandezza_da_rappresentare_6,
    ShowMinMaxCombo=mostra_combinazioni_minime_e_massime_6,
    GraphicTitle=titolo_del_grafico_6,
    KeepRunning=aggiornamento_automatico_10)  # -> SVG, File, Minimum, Maximum

# ----
flusso_n_mm = Panel(pioli_per_stazione_e_combo.ConnectionFlow)
forza_per_piolo_kn = Panel(pioli_per_stazione_e_combo.ForcePerStud)
rapporto_piolo = Panel(pioli_per_stazione_e_combo.ForceRatio)
verifica_intermedi = BridgeDetailCheck(SectionResult=sezioni_irrigiditori_intermedi.Results, IntermediateStiffener=intermedi_200x20_pannelli2m)  # -> SectionResult, Check, Demand, Resistance, Units, Ratio, Status, Warnings

# ---- group: Bridge Support Stiffener
abilita_componente_8 = BooleanToggle(True)
disposizione_irrigiditori_2 = ValueList({"Symmetric": 0, "LeftOnly": 1, "RightOnly": 2, "Unequal": 3}, selected="Symmetric")
larghezza_piatto_sinistro_mm_2 = Slider(200, range=0..400)
spessore_piatto_sinistro_mm_2 = Slider(25, range=0..50)
larghezza_piatto_destro_mm_2 = Slider(250, range=0..500)
spessore_piatto_destro_mm_2 = Slider(25, range=0..50)
lunghezza_pannello_sinistro_mm_2 = Slider(2000, range=0..4000)
lunghezza_pannello_destro_mm_2 = Slider(2000, range=0..4000)
distanza_estremità_trave_mm = Slider(250, range=0..500)
eccentricità_carico_x_mm_2 = Slider(0, range=0..1)
eccentricità_carico_z_mm = Slider(0, range=0..1)
lunghezza_impronta_appoggio_mm = Slider(400, range=0..800)
larghezza_impronta_appoggio_mm = Slider(600, range=0..1200)
coefficiente_lunghezza_libera_2 = Slider(1, range=0..2)
montante_terminale_rigido = BooleanToggle(False)
interasse_montanti_terminali_mm = Slider(300, range=0..600)
verifica_saldature_2 = BooleanToggle(True)
gola_cordone_saldatura_mm_2 = Slider(10, range=0..20)
appoggio_r_fem_per_combinazione = BridgeSupportStiffener(
    Enabled=abilita_componente_8,
    Layout=disposizione_irrigiditori_2,
    Width=larghezza_piatto_sinistro_mm_2,
    Thickness=spessore_piatto_sinistro_mm_2,
    RightWidth=larghezza_piatto_destro_mm_2,
    RightThickness=spessore_piatto_destro_mm_2,
    Location=appoggi_e_reazioni_reali.EndType,
    LeftPanel=lunghezza_pannello_sinistro_mm_2,
    RightPanel=lunghezza_pannello_destro_mm_2,
    ReactionKN=appoggi_e_reazioni_reali.CompressionKN,
    EndDistance=distanza_estremità_trave_mm,
    LoadX=eccentricità_carico_x_mm_2,
    LoadZ=eccentricità_carico_z_mm,
    FootprintLength=lunghezza_impronta_appoggio_mm,
    FootprintWidth=larghezza_impronta_appoggio_mm,
    LengthFactor=coefficiente_lunghezza_libera_2,
    RigidEndPost=montante_terminale_rigido,
    EndPostSpacing=interasse_montanti_terminali_mm,
    CheckWelds=verifica_saldature_2,
    WeldThroat=gola_cordone_saldatura_mm_2)

# ---- group: Bridge Plot Preview
indice_grafico_da_visualizzare_5 = Slider(0, range=0..1)
larghezza_anteprima_px_5 = Slider(600, range=0..1200)
bridge_plot_preview_5 = BridgePlotPreview(SVG=flatten(bridge_stud_plot.SVG), Index=indice_grafico_da_visualizzare_5, Width=larghezza_anteprima_px_5)

# ----
verifiche_intermedi_g2 = BridgeDetailCheck(SectionResult=intermedi_g2_2.Results, IntermediateStiffener=intermedi_200x20_pannelli2m)  # -> SectionResult, Check, Demand, Resistance, Units, Ratio, Status, Warnings

# ---- group: Bridge Support Stiffener
abilita_componente_9 = BooleanToggle(True)
disposizione_irrigiditori_3 = ValueList({"Symmetric": 0, "LeftOnly": 1, "RightOnly": 2, "Unequal": 3}, selected="Symmetric")
larghezza_piatto_sinistro_mm_3 = Slider(200, range=0..400)
spessore_piatto_sinistro_mm_3 = Slider(25, range=0..50)
larghezza_piatto_destro_mm_3 = Slider(250, range=0..500)
spessore_piatto_destro_mm_3 = Slider(25, range=0..50)
lunghezza_pannello_sinistro_mm_3 = Slider(2000, range=0..4000)
lunghezza_pannello_destro_mm_3 = Slider(2000, range=0..4000)
distanza_estremità_trave_mm_2 = Slider(250, range=0..500)
eccentricità_carico_x_mm_3 = Slider(0, range=0..1)
eccentricità_carico_z_mm_2 = Slider(0, range=0..1)
lunghezza_impronta_appoggio_mm_2 = Slider(400, range=0..800)
larghezza_impronta_appoggio_mm_2 = Slider(600, range=0..1200)
coefficiente_lunghezza_libera_3 = Slider(1, range=0..2)
montante_terminale_rigido_2 = BooleanToggle(False)
interasse_montanti_terminali_mm_2 = Slider(300, range=0..600)
verifica_saldature_3 = BooleanToggle(True)
gola_cordone_saldatura_mm_3 = Slider(10, range=0..20)
irrigiditori_appoggi_g2 = BridgeSupportStiffener(
    Enabled=abilita_componente_9,
    Layout=disposizione_irrigiditori_3,
    Width=larghezza_piatto_sinistro_mm_3,
    Thickness=spessore_piatto_sinistro_mm_3,
    RightWidth=larghezza_piatto_destro_mm_3,
    RightThickness=spessore_piatto_destro_mm_3,
    Location=appoggi_g2_2.EndType,
    LeftPanel=lunghezza_pannello_sinistro_mm_3,
    RightPanel=lunghezza_pannello_destro_mm_3,
    ReactionKN=appoggi_g2_2.CompressionKN,
    EndDistance=distanza_estremità_trave_mm_2,
    LoadX=eccentricità_carico_x_mm_3,
    LoadZ=eccentricità_carico_z_mm_2,
    FootprintLength=lunghezza_impronta_appoggio_mm_2,
    FootprintWidth=larghezza_impronta_appoggio_mm_2,
    LengthFactor=coefficiente_lunghezza_libera_3,
    RigidEndPost=montante_terminale_rigido_2,
    EndPostSpacing=interasse_montanti_terminali_mm_2,
    CheckWelds=verifica_saldature_3,
    WeldThroat=gola_cordone_saldatura_mm_3)

# ---- group: Bridge Plot Preview
indice_grafico_da_visualizzare_6 = Slider(0, range=0..1)
larghezza_anteprima_px_6 = Slider(600, range=0..1200)
bridge_plot_preview_6 = BridgePlotPreview(SVG=flatten(bridge_stud_plot_g2.SVG), Index=indice_grafico_da_visualizzare_6, Width=larghezza_anteprima_px_6)

# ----
verifica_agli_appoggi = BridgeDetailCheck(SectionResult=appoggi_e_reazioni_reali.Results, SupportStiffener=appoggio_r_fem_per_combinazione)  # -> SectionResult, Check, Demand, Resistance, Units, Ratio, Status, Warnings

# ---- group: Bridge Intermediate Stiffener Plot
check = ValueList({"Inviluppo WR di tutte le verifiche": 0, "Intermedio · rigidezza pannelli": 1, "Intermedio · stabilità e pressoflessione II ordine": 2, "Intermedio · freccia fuori piano": 3, "Intermedio · rigidezza torsionale": 4, "Intermedio · piatti entro classe 3": 5, "Intermedio · ingombro tra piattabande": 6, "Intermedio · saldature verticali all’anima": 7, "Intermedio · saldature alle flange": 8, "Intermedio · gola minima": 9, "Intermedio · lunghezza efficace cordone": 10, "Intermedio · collegamenti": 11}, selected="Inviluppo WR di tutte le verifiche")
mostra_combinazioni_minime_e_massime_7 = BooleanToggle(True)
titolo_del_grafico_7 = Panel("Trave 1 - Irrigiditori intermedi WR")
aggiornamento_automatico_11 = BooleanToggle(True)
modalità_rappresentazione_grafico = ValueList({"WR": 0, "Domanda": 1, "Resistenza / limite": 2, "Domanda e resistenza / limite": 3}, selected="WR")
progressive_del_grafico_m = Panel("""2
4
6
8
10
14
16
18
20
22""")
bridge_intermediate_stiffener_plot = BridgeIntermediateStiffenerPlot(
    BridGHeModel=build_bridghe_model.Model,
    SuperElementBeam=composite_beam,
    Results=verifica_intermedi.SectionResult,
    Check=check,
    ShowMinMaxCombo=mostra_combinazioni_minime_e_massime_7,
    GraphicTitle=titolo_del_grafico_7,
    KeepRunning=aggiornamento_automatico_11,
    Display=modalità_rappresentazione_grafico,
    Stations=progressive_del_grafico_m)  # -> SVG, File, Minimum, Maximum, GoverningChecks, UnavailableChecks

# ----
verifiche_appoggi_g2 = BridgeDetailCheck(SectionResult=appoggi_g2_2.Results, SupportStiffener=irrigiditori_appoggi_g2)  # -> SectionResult, Check, Demand, Resistance, Units, Ratio, Status, Warnings

# ---- group: Bridge Intermediate Stiffener Plot
mostra_combinazioni_minime_e_massime_8 = BooleanToggle(True)
titolo_del_grafico_8 = Panel("Trave 2 - Irrigiditori intermedi WR")
aggiornamento_automatico_12 = BooleanToggle(True)
modalità_rappresentazione_grafico_2 = ValueList({"WR": 0, "Domanda": 1, "Resistenza / limite": 2, "Domanda e resistenza / limite": 3}, selected="WR")
progressive_del_grafico_m_2 = Panel("""2
4
6
8
10
14
16
18
20
22""")
bridge_intermediate_stiffener_plot_g2 = BridgeIntermediateStiffenerPlot(
    BridGHeModel=build_bridghe_model.Model,
    SuperElementBeam=misto_g2,
    Results=verifiche_intermedi_g2.SectionResult,
    Check=check,
    ShowMinMaxCombo=mostra_combinazioni_minime_e_massime_8,
    GraphicTitle=titolo_del_grafico_8,
    KeepRunning=aggiornamento_automatico_12,
    Display=modalità_rappresentazione_grafico_2,
    Stations=progressive_del_grafico_m_2)  # -> SVG, File, Minimum, Maximum, GoverningChecks, UnavailableChecks

# ----
tutti_gli_esiti_locali = BridgeCheckSummary(Results=[pioli_sulle_azioni_di_fase.SectionResult, verifica_intermedi.SectionResult, verifica_agli_appoggi.SectionResult, pioli_g2.SectionResult, verifiche_intermedi_g2.SectionResult, verifiche_appoggi_g2.SectionResult])  # -> Label, Phase, Check, Ratio, Status, Units, Notes, MaximumFiniteRatio, UnavailableRatios, GoverningLabels

# ---- group: Bridge Plot Preview
indice_grafico_da_visualizzare_7 = Slider(0, range=0..1)
larghezza_anteprima_px_7 = Slider(600, range=0..1200)
bridge_plot_preview_7 = BridgePlotPreview(
    SVG=flatten(bridge_intermediate_stiffener_plot.SVG),
    Index=indice_grafico_da_visualizzare_7,
    Width=larghezza_anteprima_px_7)

# ---- group: Bridge Support Stiffener Plot
check_2 = ValueList({"Inviluppo WR di tutte le verifiche": 0, "Appoggio · stabilità e pressoflessione II ordine": 1, "Appoggio · freccia fuori piano": 2, "Appoggio · rigidezza torsionale": 3, "Appoggio · piatti entro classe 3": 4, "Appoggio · ingombro tra piattabande": 5, "Appoggio · saldature verticali all’anima": 6, "Appoggio · saldature alle flange": 7, "Appoggio · gola minima": 8, "Appoggio · lunghezza efficace cordone": 9, "Appoggio · collegamenti": 10, "Appoggio · impronta trasversale sotto i piatti": 11, "Appoggio · impronta longitudinale": 12, "Appoggio · impronta entro l’estremità": 13, "Appoggio · contatto piatti/flangia": 14, "Terminale · due coppie bilaterali simmetriche": 15, "Terminale · area di ciascuna coppia": 16, "Terminale · distanza e > 0,1 hw": 17, "Terminale · e entro il pannello": 18, "Terminale · reazione e ancoraggio combinati": 19, "Seconda coppia terminale · stabilità e pressoflessione II ordine": 20, "Seconda coppia terminale · freccia fuori piano": 21, "Seconda coppia terminale · rigidezza torsionale": 22, "Seconda coppia terminale · piatti entro classe 3": 23, "Seconda coppia terminale · ingombro tra piattabande": 24, "Seconda coppia terminale · saldature verticali all’anima": 25, "Seconda coppia terminale · saldature alle flange": 26, "Seconda coppia terminale · gola minima": 27, "Seconda coppia terminale · lunghezza efficace cordone": 28, "Seconda coppia terminale · collegamenti": 29}, selected="Inviluppo WR di tutte le verifiche")
mostra_combinazioni_minime_e_massime_9 = BooleanToggle(True)
titolo_del_grafico_9 = Panel("Trave 1 - Irrigiditori agli appoggi WR")
aggiornamento_automatico_13 = BooleanToggle(True)
modalità_rappresentazione_grafico_3 = ValueList({"WR": 0, "Domanda": 1, "Resistenza / limite": 2, "Domanda e resistenza / limite": 3}, selected="WR")
progressive_del_grafico_m_3 = Panel("""0
12
24""")
bridge_support_stiffener_plot = BridgeSupportStiffenerPlot(
    BridGHeModel=build_bridghe_model.Model,
    SuperElementBeam=composite_beam,
    Results=verifica_agli_appoggi.SectionResult,
    Check=check_2,
    ShowMinMaxCombo=mostra_combinazioni_minime_e_massime_9,
    GraphicTitle=titolo_del_grafico_9,
    KeepRunning=aggiornamento_automatico_13,
    Display=modalità_rappresentazione_grafico_3,
    Stations=progressive_del_grafico_m_3)  # -> SVG, File, Minimum, Maximum, GoverningChecks, UnavailableChecks

# ---- group: Bridge Plot Preview
indice_grafico_da_visualizzare_8 = Slider(0, range=0..1)
larghezza_anteprima_px_8 = Slider(600, range=0..1200)
bridge_plot_preview_8 = BridgePlotPreview(
    SVG=flatten(bridge_intermediate_stiffener_plot_g2.SVG),
    Index=indice_grafico_da_visualizzare_8,
    Width=larghezza_anteprima_px_8)

# ---- group: Bridge Support Stiffener Plot
mostra_combinazioni_minime_e_massime_10 = BooleanToggle(True)
titolo_del_grafico_10 = Panel("Trave 2 - Irrigiditori agli appoggi WR")
aggiornamento_automatico_14 = BooleanToggle(True)
modalità_rappresentazione_grafico_4 = ValueList({"WR": 0, "Domanda": 1, "Resistenza / limite": 2, "Domanda e resistenza / limite": 3}, selected="WR")
progressive_del_grafico_m_4 = Panel("""0
12
24""")
bridge_support_stiffener_plot_g2 = BridgeSupportStiffenerPlot(
    BridGHeModel=build_bridghe_model.Model,
    SuperElementBeam=misto_g2,
    Results=verifiche_appoggi_g2.SectionResult,
    Check=check_2,
    ShowMinMaxCombo=mostra_combinazioni_minime_e_massime_10,
    GraphicTitle=titolo_del_grafico_10,
    KeepRunning=aggiornamento_automatico_14,
    Display=modalità_rappresentazione_grafico_4,
    Stations=progressive_del_grafico_m_4)  # -> SVG, File, Minimum, Maximum, GoverningChecks, UnavailableChecks

# ----
riepilogo_controllo_governante_per_stazi = Panel(tutti_gli_esiti_locali.GoverningLabels)  # "Riepilogo — controllo governante per stazione"

# ---- group: Bridge Report
percorso_template_word = Panel("Template_BridGHe.docx")
percorso_report_word = Panel("Report_REV004.docx")
titolo_del_report = Panel("Verifiche del flusso ponte misto REV004")
descrizione_progetto = Panel("Esempio 99 | 12 + 12 m | combinazioni DEMO | RH70% cemento N 7-365 giorni")
autore_report = Panel("BridGHe")
revisione_report = Panel("REV004")
sovrascrivi_file_esistente_3 = BooleanToggle(False)
topics = ValueList({"Modello": 0, "Sezioni e materiali": 1, "Fasi e combinazioni": 2, "Verifiche": 3, "Casi governanti": 4, "Grafici": 5, "Tabulato completo": 6}, selected=["Fasi e combinazioni", "Grafici"])
report_completo_rev004 = BridgeReport(
    Results=[pioli_sulle_azioni_di_fase.SectionResult, verifica_intermedi.SectionResult, verifica_agli_appoggi.SectionResult, pioli_g2.SectionResult, verifiche_intermedi_g2.SectionResult, verifiche_appoggi_g2.SectionResult],
    Template=percorso_template_word,
    File=percorso_report_word,
    Topics=topics,
    Model=build_bridghe_model.Model,
    Title=titolo_del_report,
    Project=descrizione_progetto,
    Author=autore_report,
    Revision=revisione_report,
    SVG=[bridge_force_plot.SVG, bridge_stress_plot.SVG, bridge_stud_plot.SVG, bridge_intermediate_stiffener_plot.SVG, bridge_support_stiffener_plot.SVG, bridge_force_plot_g2.SVG, bridge_stress_plot_g2.SVG, bridge_stud_plot_g2.SVG, bridge_intermediate_stiffener_plot_g2.SVG, bridge_support_stiffener_plot_g2.SVG],
    Overwrite=sovrascrivi_file_esistente_3)  # -> File, Summary, Warnings, ReportID

# ---- group: Bridge Plot Preview
indice_grafico_da_visualizzare_9 = Slider(0, range=0..1)
larghezza_anteprima_px_9 = Slider(600, range=0..1200)
bridge_plot_preview_9 = BridgePlotPreview(SVG=flatten(bridge_support_stiffener_plot.SVG), Index=indice_grafico_da_visualizzare_9, Width=larghezza_anteprima_px_9)

indice_grafico_da_visualizzare_10 = Slider(0, range=0..1)
larghezza_anteprima_px_10 = Slider(600, range=0..1200)
bridge_plot_preview_10 = BridgePlotPreview(
    SVG=flatten(bridge_support_stiffener_plot_g2.SVG),
    Index=indice_grafico_da_visualizzare_10,
    Width=larghezza_anteprima_px_10)

# ==== cluster Cluster
radius = ClusterInput()
A = ClusterInput()
B = ClusterInput()
circle = Circle(Plane=PlaneXY(0, 0, 0), Radius=expr("x/2", radius))
division = Division(A=A, B=B)
multiplication = Multiplication(A=division, B=0.1)
area = Area(Geometry=circle)  # -> Area, Centroid
multiplication_2 = Multiplication(A=area.Area, B=multiplication)
result = ClusterOutput(multiplication_2)
